# Dynamo graph 01CreateWall.dyn (Dynamo 2.13.1.3887)
# packages: Clockwork for Dynamo 2.x 2.4.0, archi-lab.net 2023.213.1622

byCurveAndHeight = Wall.ByCurveAndHeight()  # unwired: curve, height, level, wallType
byCurveAndLevels = Wall.ByCurveAndLevels()  # unwired: curve, startLevel, endLevel, wallType
flip = Custom[Wall.Flip]()  # package Clockwork for Dynamo 2.x; Flips the orientation of a given wall - DO ***NOT*** USE IN AUTOMATIC MODE; unwired: wall
getFaces = archilab.Revit.Elements.Walls.GetFaces()  # unwired: wall
wallType = archilab.Revit.Elements.Walls.WallType()  # unwired: wall
byFace = Wall.ByFace()  # unwired: locationLine, wallType, surface
wall_location = WallLocation()  # nothing selected
isLineBased = archilab.Revit.Elements.Walls.IsLineBased()  # unwired: wall
transpose = List.Transpose()  # unwired: lists
file_path = Filename("..\simpleWall.xlsx")
file_from_path = FileObject(path=file_path)
code_block = CodeBlock { "Sheet1"; }
importExcel = Data.ImportExcel(file=file_from_path, sheetName=code_block)
code_block_2 = CodeBlock(StartPointX=importExcel) { StartPointX[0]; }
code_block_3 = CodeBlock(s=code_block_2) { s[0]; s[1]; }
byCoordinates = Point.ByCoordinates(x=code_block_3.out0, y=code_block_3.out1)
code_block_4 = CodeBlock(StartPointX=importExcel) { StartPointX[1]; }
code_block_5 = CodeBlock(s=code_block_4) { s[0]; s[1]; }
byCoordinates_2 = Point.ByCoordinates(x=code_block_5.out0, y=code_block_5.out1)
byStartPointEndPoint = Line.ByStartPointEndPoint(startPoint=byCoordinates, endPoint=byCoordinates_2)
code_block_6 = CodeBlock { 5000; }
levels = Levels("Level 1")
wall_types = WallTypes("Curtain_Wall-Storefront")
byCurveAndHeight_2 = Wall.ByCurveAndHeight(curve=byStartPointEndPoint, height=code_block_6, level=levels, wallType=wall_types)
code_block_7 = CodeBlock(StartPointX=importExcel) { StartPointX[3]; }
code_block_8 = CodeBlock(s=code_block_7) { s[0]; s[1]; }
byCoordinates_3 = Point.ByCoordinates(x=code_block_8.out0, y=code_block_8.out1)
byStartPointEndPoint_2 = Line.ByStartPointEndPoint(startPoint=byCoordinates_3, endPoint=byCoordinates)
byCurveAndHeight_3 = Wall.ByCurveAndHeight(curve=byStartPointEndPoint_2, height=code_block_6, level=levels, wallType=wall_types)
code_block_9 = CodeBlock(StartPointX=importExcel) { StartPointX[2]; }
code_block_10 = CodeBlock(s=code_block_9) { s[0]; s[1]; }
byCoordinates_4 = Point.ByCoordinates(x=code_block_10.out0, y=code_block_10.out1)
byStartPointEndPoint_3 = Line.ByStartPointEndPoint(startPoint=byCoordinates_4, endPoint=byCoordinates_3)
byCurveAndHeight_4 = Wall.ByCurveAndHeight(curve=byStartPointEndPoint_3, height=code_block_6, level=levels, wallType=wall_types)
byStartPointEndPoint_4 = Line.ByStartPointEndPoint(startPoint=byCoordinates_2, endPoint=byCoordinates_4)
byCurveAndHeight_5 = Wall.ByCurveAndHeight(curve=byStartPointEndPoint_4, height=code_block_6, level=levels, wallType=wall_types)
