# Dynamo graph 02RoomWDivs.dyn (Dynamo 2.13.1.3887)
# packages: Clockwork for Dynamo 2.x 2.4.0, archi-lab.net 2023.213.1622

wall_location = WallLocation()  # nothing selected
byFace = Wall.ByFace()  # unwired: locationLine, wallType, surface
byCurveAndLevels = Wall.ByCurveAndLevels()  # unwired: curve, startLevel, endLevel, wallType
flip = Custom[Wall.Flip]()  # package Clockwork for Dynamo 2.x; Flips the orientation of a given wall - DO ***NOT*** USE IN AUTOMATIC MODE; unwired: wall
isLineBased = archilab.Revit.Elements.Walls.IsLineBased()  # unwired: wall
byCurveAndHeight = Wall.ByCurveAndHeight()  # unwired: curve, height, level, wallType
getFaces = archilab.Revit.Elements.Walls.GetFaces()  # unwired: wall
wallType = archilab.Revit.Elements.Walls.WallType()  # unwired: wall
code_block = CodeBlock { 0; }
removeItemAtIndex = List.RemoveItemAtIndex(indices=code_block)  # unwired: list
transpose = List.Transpose(lists=removeItemAtIndex)
code_block_2 = CodeBlock(StartPointX=transpose) { StartPointX[0]; }
byCoordinates = Point.ByCoordinates()
byCoordinates_2 = Point.ByCoordinates()
byStartPointEndPoint = Line.ByStartPointEndPoint()  # unwired: startPoint, endPoint
byCurveAndHeight_2 = Wall.ByCurveAndHeight()  # unwired: curve, height, level, wallType
file_path = Filename("..\simpleWall.xlsx")
file_from_path = FileObject(path=file_path)
code_block_3 = CodeBlock { "Sheet2"; }
importExcel = Data.ImportExcel(file=file_from_path, sheetName=code_block_3)
code_block_4 = CodeBlock { 3050; }
levels = Levels("Level 1")
wall_types = WallTypes("Stacked_Wall-Partn_12P-70MStd-12P")

# group: Outside Line
code_block_5 = CodeBlock(StartPointX=importExcel) { StartPointX[0]; }
code_block_6 = CodeBlock(s=code_block_5) { s[0]; s[1]; }
byCoordinates_3 = Point.ByCoordinates(x=code_block_6.out0, y=code_block_6.out1)
code_block_7 = CodeBlock(StartPointX=importExcel) { StartPointX[1]; }
code_block_8 = CodeBlock(s=code_block_7) { s[0]; s[1]; }
byCoordinates_4 = Point.ByCoordinates(x=code_block_8.out0, y=code_block_8.out1)
byStartPointEndPoint_2 = Line.ByStartPointEndPoint(startPoint=byCoordinates_3, endPoint=byCoordinates_4)
byCurveAndHeight_3 = Wall.ByCurveAndHeight(curve=byStartPointEndPoint_2, height=code_block_4, level=levels, wallType=wall_types)
code_block_9 = CodeBlock(StartPointX=importExcel) { StartPointX[3]; }
code_block_10 = CodeBlock(s=code_block_9) { s[0]; s[1]; }
byCoordinates_5 = Point.ByCoordinates(x=code_block_10.out0, y=code_block_10.out1)
code_block_11 = CodeBlock(StartPointX=importExcel) { StartPointX[4]; }
code_block_12 = CodeBlock(s=code_block_11) { s[0]; s[1]; }
byCoordinates_6 = Point.ByCoordinates(x=code_block_12.out0, y=code_block_12.out1)
byStartPointEndPoint_3 = Line.ByStartPointEndPoint(startPoint=byCoordinates_5, endPoint=byCoordinates_6)
byCurveAndHeight_4 = Wall.ByCurveAndHeight(curve=byStartPointEndPoint_3, height=code_block_4, level=levels, wallType=wall_types)
code_block_13 = CodeBlock(StartPointX=importExcel) { StartPointX[2]; }
code_block_14 = CodeBlock(s=code_block_13) { s[0]; s[1]; }
byCoordinates_7 = Point.ByCoordinates(x=code_block_14.out0, y=code_block_14.out1)
byStartPointEndPoint_4 = Line.ByStartPointEndPoint(startPoint=byCoordinates_4, endPoint=byCoordinates_7)
byCurveAndHeight_5 = Wall.ByCurveAndHeight(curve=byStartPointEndPoint_4, height=code_block_4, level=levels, wallType=wall_types)
byStartPointEndPoint_5 = Line.ByStartPointEndPoint(startPoint=byCoordinates_7, endPoint=byCoordinates_5)
byCurveAndHeight_6 = Wall.ByCurveAndHeight(curve=byStartPointEndPoint_5, height=code_block_4, level=levels, wallType=wall_types)
code_block_15 = CodeBlock(StartPointX=importExcel) { StartPointX[5]; }
code_block_16 = CodeBlock(s=code_block_15) { s[0]; s[1]; }
byCoordinates_8 = Point.ByCoordinates(x=code_block_16.out0, y=code_block_16.out1)
byStartPointEndPoint_6 = Line.ByStartPointEndPoint(startPoint=byCoordinates_6, endPoint=byCoordinates_8)
byCurveAndHeight_7 = Wall.ByCurveAndHeight(curve=byStartPointEndPoint_6, height=code_block_4, level=levels, wallType=wall_types)
code_block_17 = CodeBlock(StartPointX=importExcel) { StartPointX[6]; }
code_block_18 = CodeBlock(s=code_block_17) { s[0]; s[1]; }
byCoordinates_9 = Point.ByCoordinates(x=code_block_18.out0, y=code_block_18.out1)
code_block_19 = CodeBlock(StartPointX=importExcel) { StartPointX[7]; }
code_block_20 = CodeBlock(s=code_block_19) { s[0]; s[1]; }
byCoordinates_10 = Point.ByCoordinates(x=code_block_20.out0, y=code_block_20.out1)
byStartPointEndPoint_7 = Line.ByStartPointEndPoint(startPoint=byCoordinates_9, endPoint=byCoordinates_10)
byCurveAndHeight_8 = Wall.ByCurveAndHeight(curve=byStartPointEndPoint_7, height=code_block_4, level=levels, wallType=wall_types)
byStartPointEndPoint_8 = Line.ByStartPointEndPoint(startPoint=byCoordinates_8, endPoint=byCoordinates_9)
byCurveAndHeight_9 = Wall.ByCurveAndHeight(curve=byStartPointEndPoint_8, height=code_block_4, level=levels, wallType=wall_types)
code_block_21 = CodeBlock(StartPointX=importExcel) { StartPointX[8]; }
code_block_22 = CodeBlock(s=code_block_21) { s[0]; s[1]; }
byCoordinates_11 = Point.ByCoordinates(x=code_block_22.out0, y=code_block_22.out1)
byStartPointEndPoint_9 = Line.ByStartPointEndPoint(startPoint=byCoordinates_10, endPoint=byCoordinates_11)
byCurveAndHeight_10 = Wall.ByCurveAndHeight(curve=byStartPointEndPoint_9, height=code_block_4, level=levels, wallType=wall_types)
code_block_23 = CodeBlock(StartPointX=importExcel) { StartPointX[9]; }
code_block_24 = CodeBlock(s=code_block_23) { s[0]; s[1]; }
byCoordinates_12 = Point.ByCoordinates(x=code_block_24.out0, y=code_block_24.out1)
byStartPointEndPoint_10 = Line.ByStartPointEndPoint(startPoint=byCoordinates_11, endPoint=byCoordinates_12)
byCurveAndHeight_11 = Wall.ByCurveAndHeight(curve=byStartPointEndPoint_10, height=code_block_4, level=levels, wallType=wall_types)
code_block_25 = CodeBlock(StartPointX=importExcel) { StartPointX[11]; }
code_block_26 = CodeBlock(s=code_block_25) { s[0]; s[1]; }
byCoordinates_13 = Point.ByCoordinates(x=code_block_26.out0, y=code_block_26.out1)
code_block_27 = CodeBlock(StartPointX=importExcel) { StartPointX[12]; }
code_block_28 = CodeBlock(s=code_block_27) { s[0]; s[1]; }
byCoordinates_14 = Point.ByCoordinates(x=code_block_28.out0, y=code_block_28.out1)
byStartPointEndPoint_11 = Line.ByStartPointEndPoint(startPoint=byCoordinates_13, endPoint=byCoordinates_14)
byCurveAndHeight_12 = Wall.ByCurveAndHeight(curve=byStartPointEndPoint_11, height=code_block_4, level=levels, wallType=wall_types)
code_block_29 = CodeBlock(StartPointX=importExcel) { StartPointX[10]; }
code_block_30 = CodeBlock(s=code_block_29) { s[0]; s[1]; }
byCoordinates_15 = Point.ByCoordinates(x=code_block_30.out0, y=code_block_30.out1)
byStartPointEndPoint_12 = Line.ByStartPointEndPoint(startPoint=byCoordinates_15, endPoint=byCoordinates_13)
byCurveAndHeight_13 = Wall.ByCurveAndHeight(curve=byStartPointEndPoint_12, height=code_block_4, level=levels, wallType=wall_types)
byStartPointEndPoint_13 = Line.ByStartPointEndPoint(startPoint=byCoordinates_12, endPoint=byCoordinates_15)
byCurveAndHeight_14 = Wall.ByCurveAndHeight(curve=byStartPointEndPoint_13, height=code_block_4, level=levels, wallType=wall_types)
code_block_31 = CodeBlock(StartPointX=importExcel) { StartPointX[13]; }
code_block_32 = CodeBlock(s=code_block_31) { s[0]; s[1]; }
byCoordinates_16 = Point.ByCoordinates(x=code_block_32.out0, y=code_block_32.out1)
byStartPointEndPoint_14 = Line.ByStartPointEndPoint(startPoint=byCoordinates_14, endPoint=byCoordinates_16)
byCurveAndHeight_15 = Wall.ByCurveAndHeight(curve=byStartPointEndPoint_14, height=code_block_4, level=levels, wallType=wall_types)
code_block_33 = CodeBlock(StartPointX=importExcel) { StartPointX[14]; }
code_block_34 = CodeBlock(s=code_block_33) { s[0]; s[1]; }
byCoordinates_17 = Point.ByCoordinates(x=code_block_34.out0, y=code_block_34.out1)
byStartPointEndPoint_15 = Line.ByStartPointEndPoint(startPoint=byCoordinates_16, endPoint=byCoordinates_17)
byCurveAndHeight_16 = Wall.ByCurveAndHeight(curve=byStartPointEndPoint_15, height=code_block_4, level=levels, wallType=wall_types)
byStartPointEndPoint_16 = Line.ByStartPointEndPoint(startPoint=byCoordinates_17, endPoint=byCoordinates_3)
byCurveAndHeight_17 = Wall.ByCurveAndHeight(curve=byStartPointEndPoint_16, height=code_block_4, level=levels, wallType=wall_types)

# group: Inner Points
code_block_35 = CodeBlock(StartPointX=importExcel) { StartPointX[15]; }
code_block_36 = CodeBlock(s=code_block_35) { s[0]; s[1]; }
byCoordinates_18 = Point.ByCoordinates(x=code_block_36.out0, y=code_block_36.out1)
code_block_37 = CodeBlock(StartPointX=importExcel) { StartPointX[16]; }
code_block_38 = CodeBlock(s=code_block_37) { s[0]; s[1]; }
byCoordinates_19 = Point.ByCoordinates(x=code_block_38.out0, y=code_block_38.out1)
code_block_39 = CodeBlock(StartPointX=importExcel) { StartPointX[17]; }
code_block_40 = CodeBlock(s=code_block_39) { s[0]; s[1]; }
byCoordinates_20 = Point.ByCoordinates(x=code_block_40.out0, y=code_block_40.out1)
code_block_41 = CodeBlock(StartPointX=importExcel) { StartPointX[18]; }
code_block_42 = CodeBlock(s=code_block_41) { s[0]; s[1]; }
byCoordinates_21 = Point.ByCoordinates(x=code_block_42.out0, y=code_block_42.out1)

# group: Inner walls
byStartPointEndPoint_17 = Line.ByStartPointEndPoint(startPoint=byCoordinates_16, endPoint=byCoordinates_18)
byCurveAndHeight_18 = Wall.ByCurveAndHeight(curve=byStartPointEndPoint_17, height=code_block_4, level=levels, wallType=wall_types)
byStartPointEndPoint_18 = Line.ByStartPointEndPoint(startPoint=byCoordinates_18, endPoint=byCoordinates_19)
byCurveAndHeight_19 = Wall.ByCurveAndHeight(curve=byStartPointEndPoint_18, height=code_block_4, level=levels, wallType=wall_types)
byStartPointEndPoint_19 = Line.ByStartPointEndPoint(startPoint=byCoordinates_19, endPoint=byCoordinates_20)
byCurveAndHeight_20 = Wall.ByCurveAndHeight(curve=byStartPointEndPoint_19, height=code_block_4, level=levels, wallType=wall_types)
byStartPointEndPoint_20 = Line.ByStartPointEndPoint(startPoint=byCoordinates_20, endPoint=byCoordinates_21)
byCurveAndHeight_21 = Wall.ByCurveAndHeight(curve=byStartPointEndPoint_20, height=code_block_4, level=levels, wallType=wall_types)
byStartPointEndPoint_21 = Line.ByStartPointEndPoint(startPoint=byCoordinates_21, endPoint=byCoordinates_12)
byCurveAndHeight_22 = Wall.ByCurveAndHeight(curve=byStartPointEndPoint_21, height=code_block_4, level=levels, wallType=wall_types)
byStartPointEndPoint_22 = Line.ByStartPointEndPoint(startPoint=byCoordinates_18, endPoint=byCoordinates_13)
byCurveAndHeight_23 = Wall.ByCurveAndHeight(curve=byStartPointEndPoint_22, height=code_block_4, level=levels, wallType=wall_types)
byStartPointEndPoint_23 = Line.ByStartPointEndPoint(startPoint=byCoordinates_21, endPoint=byCoordinates_9)
byCurveAndHeight_24 = Wall.ByCurveAndHeight(curve=byStartPointEndPoint_23, height=code_block_4, level=levels, wallType=wall_types)
byStartPointEndPoint_24 = Line.ByStartPointEndPoint(startPoint=byCoordinates_20, endPoint=byCoordinates_6)
byCurveAndHeight_25 = Wall.ByCurveAndHeight(curve=byStartPointEndPoint_24, height=code_block_4, level=levels, wallType=wall_types)
byStartPointEndPoint_25 = Line.ByStartPointEndPoint(startPoint=byCoordinates_7, endPoint=byCoordinates_19)
byCurveAndHeight_26 = Wall.ByCurveAndHeight(curve=byStartPointEndPoint_25, height=code_block_4, level=levels, wallType=wall_types)
byStartPointEndPoint_26 = Line.ByStartPointEndPoint(startPoint=byCoordinates_19, endPoint=byCoordinates_20)
byCurveAndHeight_27 = Wall.ByCurveAndHeight(curve=byStartPointEndPoint_26, height=code_block_4, level=levels, wallType=wall_types)

code_block_43 = CodeBlock(StartPointX=importExcel) { StartPointX[19]; }
code_block_44 = CodeBlock(s=code_block_43) { s[0]; s[1]; }
byCoordinates_22 = Point.ByCoordinates(x=code_block_44.out0, y=code_block_44.out1)
byStartPointEndPoint_27 = Line.ByStartPointEndPoint(startPoint=byCoordinates_3, endPoint=byCoordinates_22)
byCurveAndHeight_28 = Wall.ByCurveAndHeight(curve=byStartPointEndPoint_27, height=code_block_4, level=levels, wallType=wall_types)
code_block_45 = CodeBlock(StartPointX=importExcel) { StartPointX[20]; }
code_block_46 = CodeBlock(s=code_block_45) { s[0]; s[1]; }
byCoordinates_23 = Point.ByCoordinates(x=code_block_46.out0, y=code_block_46.out1)
byStartPointEndPoint_28 = Line.ByStartPointEndPoint(startPoint=byCoordinates_23, endPoint=byCoordinates_3)
byCurveAndHeight_29 = Wall.ByCurveAndHeight(curve=byStartPointEndPoint_28, height=code_block_4, level=levels, wallType=wall_types)
code_block_47 = CodeBlock(StartPointX=importExcel) { StartPointX[21]; }
code_block_48 = CodeBlock(s=code_block_47) { s[0]; s[1]; }
byCoordinates_24 = Point.ByCoordinates(x=code_block_48.out0, y=code_block_48.out1)
byStartPointEndPoint_29 = Line.ByStartPointEndPoint(startPoint=byCoordinates_22, endPoint=byCoordinates_24)
byCurveAndHeight_30 = Wall.ByCurveAndHeight(curve=byStartPointEndPoint_29, height=code_block_4, level=levels, wallType=wall_types)
byStartPointEndPoint_30 = Line.ByStartPointEndPoint(startPoint=byCoordinates_23, endPoint=byCoordinates_24)
byCurveAndHeight_31 = Wall.ByCurveAndHeight(curve=byStartPointEndPoint_30, height=code_block_4, level=levels, wallType=wall_types)
