# Dynamo graph 04getWallExcell.dyn "changeWall" (Dynamo 2.13.1.3887)
# packages: archi-lab.net 2023.213.1622, Clockwork for Dynamo 2.x 2.4.0, Spring - Dynamo 2.0 0.0.3

# group: Extract walls, doors, and windows of "Placed only" rooms by the level of the building
levels = Levels("1ER ETAGE")
boolean = BoolSelector(true)
get_rooms_by_level = Custom[Get Rooms by Level](level=levels, excludeUnplaced=boolean)  # package archi-lab.net; Filters Rooms by level.
python_script = Python(IN[0]=get_rooms_by_level.room)  # CPython3
# ---------- python_script.python (46 lines) ----------
# Load the Python Standard and DesignScript Libraries
import sys
import clr
clr.AddReference('ProtoGeometry')
from Autodesk.DesignScript.Geometry import *

# The inputs to this node will be stored as a list in the IN variables.
clr.AddReference("RevitNodes")
import Revit
clr.ImportExtensions(Revit.Elements)
clr.ImportExtensions(Revit.GeometryConversion)

clr.AddReference("RevitServices")
import RevitServices
from RevitServices.Persistence import DocumentManager
from RevitServices.Transactions import TransactionManager

clr.AddReference("RevitAPI")

clr.AddReference("RevitAPI")
import Autodesk
from Autodesk.Revit.DB import *

doc = DocumentManager.Instance.CurrentDBDocument

rooms_d = IN[0] if isinstance(IN[0], list) else [IN[0]]
roomss = UnwrapElement(rooms_d)

settings = Autodesk.Revit.DB.AreaVolumeSettings.GetAreaVolumeSettings(doc)

options = Autodesk.Revit.DB.SpatialElementBoundaryOptions()
b_option = settings.GetSpatialElementBoundaryLocation(SpatialElementType.Room)

options.SpatialElementBoundaryLocation = b_option

curveslist = []
for room in roomss:
    curves = []
    for boundlist in room.GetBoundarySegments(options):
        for bound in boundlist:
            curves.append (bound.GetCurve().ToProtoType())
    curveslist.append(curves)
# Place your code below this line

# Assign your output to the OUT variable.
OUT = curveslist
# ----------------------------------------
number = Room.Number(room=get_rooms_by_level.room)
boundaries = archilab.Revit.Elements.Room.Boundaries(room=get_rooms_by_level.room)
clear_list = Custom[Clear List](input=boundaries.Elements)  # package archi-lab.net; This node will remove all Null and Empty Lists from any list.
uniqueItems = List.UniqueItems(list=clear_list)
doors = Custom[Room.Doors](door=get_rooms_by_level.room)  # package Clockwork for Dynamo 2.x; Retrieves all doors that are associated with a room (hosted in walls and roofs).
windows = Custom[Room.Windows](door=get_rooms_by_level.room)  # package Clockwork for Dynamo 2.x; Retrieves all windows that are associated with a room (hosted in walls and roofs).

# group: Separating Wall only of all rooms
type = Object.Type(object=uniqueItems)
code_block = CodeBlock { "Wall"; }
contains = String.Contains(string=type, searchFor=code_block)
filterByBoolMask = List.FilterByBoolMask(list=uniqueItems, mask=contains)
id = Element.Id(element=filterByBoolMask.in)
firstItem = List.FirstItem(list=id@L3)
id_2 = Element.Id(element=uniqueItems)

# group: Extract Door IDs
id_3 = Element.Id(element=doors)

# group: Extract Windows ID
id_4 = Element.Id(element=windows)

# group: Writing Data to Excel
code_block_2 = CodeBlock { "Walls"; 0; 1; false; "Doors"; "Windows"; true; }
exportToExcel = Data.ExportToExcel(sheetName=code_block_2.out0, startRow=code_block_2.out1, startColumn=code_block_2.out1, data=get_rooms_by_level.roomName, overWrite=code_block_2.out3)  # unwired: filePath
file_path = Filename(".\oetrange.xlsx")
exportToExcel_2 = Data.ExportToExcel(sheetName=code_block_2.out0, startRow=code_block_2.out1, startColumn=code_block_2.out2, data=number, overWrite=code_block_2.out3)  # unwired: filePath
code_block_3 = CodeBlock { 2; 3; 4; 5; 6; 7; 8; 9; }
exportToExcel_3 = Data.ExportToExcel(sheetName=code_block_2.out0, startRow=code_block_2.out1, startColumn=code_block_3.out0, data=firstItem, overWrite=code_block_2.out3)  # unwired: filePath
exportToExcel_4 = Data.ExportToExcel(sheetName=code_block_2.out4, startRow=code_block_2.out1, startColumn=code_block_2.out1, data=id_3, overWrite=code_block_2.out3)  # unwired: filePath
exportToExcel_5 = Data.ExportToExcel(sheetName=code_block_2.out5, startRow=code_block_2.out1, startColumn=code_block_2.out1, data=id_4, overWrite=code_block_2.out3)  # unwired: filePath

# group: Sorting by ID
identity = Object.Identity(object=filterByBoolMask.in)
flatten = List.Flatten(list=identity)
watch_heigth = Watch(flatten)
id_5 = Element.Id(element=identity)
flatten_2 = List.Flatten(list=id_5)
watch_heigth_2 = Watch(flatten_2)
sort = List.Sort(list=watch_heigth_2)
indexOf = List.IndexOf(list=sort, element=watch_heigth_2)
sortByAnother = Lists.Lists.SortByAnother(inputList=watch_heigth, sortBy=indexOf)
watch_heigth_3 = Watch(sortByAnother.sortedList)
getItemAtIndex = List.GetItemAtIndex(list=watch_heigth, index=indexOf)
watch_heigth_4 = Watch(getItemAtIndex)
watch_heigth_5 = Watch(indexOf)
watch_heigth_6 = Watch(sort)

# group: Remove Duplicates
uniqueItems_2 = List.UniqueItems(list=watch_heigth_3)
watch = Watch(uniqueItems_2)

# group: Wall Length
element_by_id = ElementById(Id=id)
parameters = Element.Parameters(element=element_by_id)
watch_2 = Watch(parameters)
watch_id = Watch(watch)
code_block_4 = CodeBlock { "Length"; "Area"; "Unconnected Height"; "Volume"; "Width"; }
getParameterValueByName = Element.GetParameterValueByName(element=watch, parameterName=code_block_4.out2)
getParameterValueByName_2 = Element.GetParameterValueByName(element=watch, parameterName=code_block_4.out0)
watch_length = Watch(getParameterValueByName_2)
watch_unconnected_height = Watch(getParameterValueByName)
getParameterValueByName_3 = Element.GetParameterValueByName(element=watch, parameterName=code_block_4.out1)
watch_area = Watch(getParameterValueByName_3)
getParameterValueByName_4 = Element.GetParameterValueByName(element=watch, parameterName=code_block_4.out3)
watch_volume = Watch(getParameterValueByName_4)

getLocation = Element.GetLocation(element=watch_id)
watch_location = Watch(getLocation)

# group: Calculate Width
flatten_3 = List.Flatten(list=watch_length)
flatten_4 = List.Flatten(list=watch_unconnected_height)
flatten_5 = List.Flatten(list=watch_area)
flatten_6 = List.Flatten(list=watch_volume)
calculated_width_python_script = Python(IN[0]=flatten_3, IN[1]=flatten_4, IN[2]=flatten_5, IN[3]=flatten_6)  # CPython3
# ---------- calculated_width_python_script.python (26 lines) ----------
# Load the Python Standard and DesignScript Libraries
import sys
import clr
clr.AddReference('ProtoGeometry')
from Autodesk.DesignScript.Geometry import *

# The inputs to this node will be stored as a list in the IN variables.
dataEnteringNode = IN
leng = IN[0]
hei = IN[1]
Area = IN[2]
Volume = IN[3]
out = list() #width

# Place your code below this line

for i in range(len(Area)):
    inter = (leng[i] * hei[i])
    v1 = Volume[i]
    v2 = v1*1000000
    inter = v2/inter
    
    out.append(inter)

# Assign your output to the OUT variable.
OUT = out
# ----------------------------------------

# group: Flat list, prepare output to excell
python_script_2 = Python(IN[0]=watch_location)  # CPython3
# ---------- python_script_2.python (37 lines) ----------
# Load the Python Standard and DesignScript Libraries
import sys
import clr
clr.AddReference('ProtoGeometry')
from Autodesk.DesignScript.Geometry import *

# The inputs to this node will be stored as a list in the IN variables.
dataEnteringNode = IN
out = list()

# Place your code below this line

for i in IN:
    for l in i:
        ss = str(l)
        ss = ss.split(" ")
                
           
                
        ss2 = ss[32]
               
                
                
        out.append(ss2)
                
                
                
                
                
           
          
            
            
           

# Assign your output to the OUT variable.
OUT = out
# ----------------------------------------
vector_direction_vector_z = Watch(python_script_2)
flatten_7 = List.Flatten(list=vector_direction_vector_z)
id_6 = Element.Id(element=watch)
watch_id_2 = Watch(id_6)
flatten_8 = List.Flatten(list=watch_id_2)
python_script_3 = Python(IN[0]=watch_location)  # CPython3
# ---------- python_script_3.python (37 lines) ----------
# Load the Python Standard and DesignScript Libraries
import sys
import clr
clr.AddReference('ProtoGeometry')
from Autodesk.DesignScript.Geometry import *

# The inputs to this node will be stored as a list in the IN variables.
dataEnteringNode = IN
out = list()

# Place your code below this line

for i in IN:
    for l in i:
        ss = str(l)
        ss = ss.split(" ")
                
           
                
        ss2 = ss[29]
               
                
                
        out.append(ss2)
                
                
                
                
                
           
          
            
            
           

# Assign your output to the OUT variable.
OUT = out
# ----------------------------------------
vector_direction_vector_y = Watch(python_script_3)
flatten_9 = List.Flatten(list=vector_direction_vector_y)
python_script_4 = Python(IN[0]=watch_location)  # CPython3
# ---------- python_script_4.python (37 lines) ----------
# Load the Python Standard and DesignScript Libraries
import sys
import clr
clr.AddReference('ProtoGeometry')
from Autodesk.DesignScript.Geometry import *

# The inputs to this node will be stored as a list in the IN variables.
dataEnteringNode = IN
out = list()

# Place your code below this line

for i in IN:
    for l in i:
        ss = str(l)
        ss = ss.split(" ")
                
           
                
        ss2 = ss[26]
               
                
                
        out.append(ss2)
                
                
                
                
                
           
          
            
            
           

# Assign your output to the OUT variable.
OUT = out
# ----------------------------------------
watch_directionvector_x = Watch(python_script_4)
flatten_10 = List.Flatten(list=watch_directionvector_x)
watch_unconnected_height_2 = Watch(getParameterValueByName)
flatten_11 = List.Flatten(list=watch_unconnected_height_2)
watch_width = Watch(calculated_width_python_script)
flatten_12 = List.Flatten(list=watch_width)
watch_area_2 = Watch(getParameterValueByName_3)
flatten_13 = List.Flatten(list=watch_area_2)
watch_length_2 = Watch(getParameterValueByName_2)
flatten_14 = List.Flatten(list=watch_length_2)
watch_volume_2 = Watch(getParameterValueByName_4)
flatten_15 = List.Flatten(list=watch_volume_2)

# group: Extract wall data Sorted By Id
code_block_5 = CodeBlock { "VectorX"; "VectorY"; "VectorZ"; "ElementID"; "Length"; "Area"; "Width"; "UnconnectedHeight"; "Volume"; }
addItemToFront = List.AddItemToFront(item=code_block_5.out2, list=flatten_7)
watch_3 = Watch(addItemToFront)
file_path_2 = Filename(".\walls.xlsx")
code_block_6 = CodeBlock { "Wall"; false; 0; 1; 2; 3; 4; 5; 6; 7; 8; }
exportToExcel_6 = Data.ExportToExcel(filePath=file_path_2, sheetName=code_block_6.out0, startRow=code_block_6.out2, startColumn=code_block_6.out4, data=addItemToFront, overWrite=code_block_6.out1)
addItemToFront_2 = List.AddItemToFront(item=code_block_5.out3, list=flatten_8)
exportToExcel_7 = Data.ExportToExcel(filePath=file_path_2, sheetName=code_block_6.out0, startRow=code_block_6.out2, startColumn=code_block_6.out5, data=addItemToFront_2, overWrite=code_block_6.out1)
addItemToFront_3 = List.AddItemToFront(item=code_block_5.out1, list=flatten_9)
watch_4 = Watch(addItemToFront_3)
addItemToFront_4 = List.AddItemToFront(item=code_block_5.out0, list=flatten_10)
exportToExcel_8 = Data.ExportToExcel(filePath=file_path_2, sheetName=code_block_6.out0, startRow=code_block_6.out2, startColumn=code_block_6.out2, data=addItemToFront_4, overWrite=code_block_6.out1)
exportToExcel_9 = Data.ExportToExcel(filePath=file_path_2, sheetName=code_block_6.out0, startRow=code_block_6.out2, startColumn=code_block_6.out3, data=addItemToFront_3, overWrite=code_block_6.out1)
watch_5 = Watch(addItemToFront_4)
watch_6 = Watch(addItemToFront_2)
addItemToFront_5 = List.AddItemToFront(item=code_block_5.out7, list=flatten_11)
exportToExcel_10 = Data.ExportToExcel(filePath=file_path_2, sheetName=code_block_6.out0, startRow=code_block_6.out2, startColumn=code_block_6.out9, data=addItemToFront_5, overWrite=code_block_6.out1)
addItemToFront_6 = List.AddItemToFront(item=code_block_5.out6, list=flatten_12)
exportToExcel_11 = Data.ExportToExcel(filePath=file_path_2, sheetName=code_block_6.out0, startRow=code_block_6.out2, startColumn=code_block_6.out8, data=addItemToFront_6, overWrite=code_block_6.out1)
addItemToFront_7 = List.AddItemToFront(item=code_block_5.out5, list=flatten_13)
exportToExcel_12 = Data.ExportToExcel(filePath=file_path_2, sheetName=code_block_6.out0, startRow=code_block_6.out2, startColumn=code_block_6.out7, data=addItemToFront_7, overWrite=code_block_6.out1)
addItemToFront_8 = List.AddItemToFront(item=code_block_5.out4, list=flatten_14)
exportToExcel_13 = Data.ExportToExcel(filePath=file_path_2, sheetName=code_block_6.out0, startRow=code_block_6.out2, startColumn=code_block_6.out6, data=addItemToFront_8, overWrite=code_block_6.out1)
addItemToFront_9 = List.AddItemToFront(item=code_block_5.out8, list=flatten_15)
exportToExcel_14 = Data.ExportToExcel(filePath=file_path_2, sheetName=code_block_6.out0, startRow=code_block_6.out2, startColumn=code_block_6.out10, data=addItemToFront_9, overWrite=code_block_6.out1)
watch_7 = Watch(addItemToFront_8)
watch_8 = Watch(addItemToFront_5)
watch_9 = Watch(addItemToFront_9)
watch_10 = Watch(addItemToFront_7)
watch_11 = Watch(addItemToFront_6)

watch_directionvector_x_2 = Watch(flatten_10)
python_script_5 = Python(IN[0]=watch_directionvector_x_2)  # CPython3
# ---------- python_script_5.python (19 lines) ----------
# Load the Python Standard and DesignScript Libraries
import sys
import clr
clr.AddReference('ProtoGeometry')
from Autodesk.DesignScript.Geometry import *

# The inputs to this node will be stored as a list in the IN variables.
dataEnteringNode = IN[0]
out = list()
# Place your code below this line
for i in IN:
    for j in i:
        s = j
        s = s.rstrip(',')
        out.append(s)
        
    
# Assign your output to the OUT variable.
OUT = out
# ----------------------------------------
toNumber = String.ToNumber(string=python_script_5)
vector_direction_vector_y_2 = Watch(flatten_9)
python_script_6 = Python(IN[0]=vector_direction_vector_y_2)  # CPython3; same code as python_script_5
toNumber_2 = String.ToNumber(string=python_script_6)
vector_direction_vector_z_2 = Watch(vector_direction_vector_z)
python_script_7 = Python(IN[0]=vector_direction_vector_z_2)  # CPython3; same code as python_script_5
toNumber_3 = String.ToNumber(string=python_script_7)
byCoordinates = Vector.ByCoordinates(x=toNumber, y=toNumber_2, z=toNumber_3)
ZAxis = Vector.ZAxis()
cross = Vector.Cross(vector=byCoordinates, cross=ZAxis)
byCoordinates_2 = Vector.ByCoordinates(z=toNumber_3)
normalized = Vector.Normalized(vector=byCoordinates)
watch_12 = Watch(watch)
watch_directionvector_x_3 = Watch(python_script_4)
vector_direction_vector_y_3 = Watch(python_script_3)
