# Dynamo graph 05MakeWallsFromBSP2File.dyn (Dynamo 2.13.1.3887)

byStartPointEndPoint = Line.ByStartPointEndPoint()  # unwired: startPoint, endPoint
byCoordinates = Point.ByCoordinates()
byCurveAndHeight = Wall.ByCurveAndHeight()  # unwired: curve, height, level, wallType

# group: Data From Excell
file_path = Filename(".\walls.xlsx")
file_from_path = FileObject(path=file_path)
code_block = CodeBlock { "Wall"; }
importExcel = Data.ImportExcel(file=file_from_path, sheetName=code_block)

# group: (IGNORE) ~item per index
code_block_2 = CodeBlock { 1; }
python_script = Python(IN[0]=importExcel)  # CPython3
# ---------- python_script.python (26 lines) ----------
# Import necessary libraries
import clr
clr.AddReference("RevitAPI")
from Autodesk.Revit.DB import XYZ
clr.AddReference("RevitNodes")
import Revit
clr.ImportExtensions(Revit.Elements)

# Input data is a list of rows, where each row is a list of x and y coordinates
input_data = IN[0]

# Initialize an empty list to store points
points = []

# Process each row in the input data
for row in input_data:
    # Check if the row has at least two elements (x and y coordinates)
    if len(row) >= 2:
        x = row[0]
        y = row[1]
        # Create a point with the x and y coordinates and add it to the points list
        point = XYZ(x, y, 0)
        points.append(point)

# Output the list of points
OUT = points
# ----------------------------------------
code_block_3 = CodeBlock { 0; }
getItemAtIndex = List.GetItemAtIndex(list=python_script, index=code_block_3)
string_from_array = FromArray(array=getItemAtIndex)
code_block_4 = CodeBlock { ", "; }
split = String.Split(string=string_from_array, separator0=code_block_4)
code_block_5 = CodeBlock(list=split) { list[0]; list[1]; list[2]; }
watch = Watch(code_block_5.out0)
code_block_6 = CodeBlock { 0; }
code_block_7 = CodeBlock { 1; }
remove = String.Remove(string=watch, startIndex=code_block_6, count=code_block_7)
watch_2 = Watch(remove)
watch_3 = Watch(code_block_5.out2)
code_block_8 = CodeBlock { -1; }
code_block_9 = CodeBlock { 1; }
remove_2 = String.Remove(string=watch_3, startIndex=code_block_8, count=code_block_9)
watch_4 = Watch(remove_2)
watch_5 = Watch(code_block_5.out1)
watch_6 = Watch(watch_5)

range = Range()
contains = BoundingBox.Contains()  # unwired: boundingBox, point
number_slider = DoubleSlider(1700, range=0..6000 step 100)
number_slider_2 = DoubleSlider(300, range=0..6000 step 100)
byCoordinates_2 = Point.ByCoordinates(x=number_slider, y=number_slider_2)

# group: All X Coords
python_script_2 = Python(IN[0]=importExcel)  # CPython3
# ---------- python_script_2.python (16 lines) ----------
# Load the Python Standard and DesignScript Libraries
import sys
import clr
clr.AddReference('ProtoGeometry')
from Autodesk.DesignScript.Geometry import *

# The inputs to this node will be stored as a list in the IN variables.
dataEnteringNode = IN

dataOutput = list()
# Place your code below this line
for i in IN:
    for j in i:
        dataOutput.append(j[1])
# Assign your output to the OUT variable.
OUT = dataOutput
# ----------------------------------------

code_block_10 = CodeBlock { 0; }
removeItemAtIndex = List.RemoveItemAtIndex(list=python_script_2, indices=code_block_10)
toNumber = String.ToNumber(string=removeItemAtIndex)

# group: All Y Coords
python_script_3 = Python(IN[0]=importExcel)  # CPython3
# ---------- python_script_3.python (16 lines) ----------
# Load the Python Standard and DesignScript Libraries
import sys
import clr
clr.AddReference('ProtoGeometry')
from Autodesk.DesignScript.Geometry import *

# The inputs to this node will be stored as a list in the IN variables.
dataEnteringNode = IN

dataOutput = list()
# Place your code below this line
for i in IN:
    for j in i:
        dataOutput.append(j[0])
# Assign your output to the OUT variable.
OUT = dataOutput
# ----------------------------------------

removeItemAtIndex_2 = List.RemoveItemAtIndex(list=python_script_3, indices=code_block_10)
code_block_11 = CodeBlock { 100; }
levels = Levels("Level 0")
wall_types = WallTypes("Stacked_Wall-Partn_12P-70MStd-12P")
toNumber_2 = String.ToNumber()  # unwired: string

# group: Make Points, Connect Lines
byCoordinates_3 = Point.ByCoordinates(x=toNumber, y=removeItemAtIndex_2)
code_block_12 = CodeBlock { 1; }
dropItems = List.DropItems(list=byCoordinates_3, amount=code_block_12)
byStartPointEndPoint_2 = Line.ByStartPointEndPoint(startPoint=byCoordinates_3)  # unwired: endPoint
byCoordinates_4 = Point.ByCoordinates(y=toNumber_2)

byCurveAndHeight_2 = Wall.ByCurveAndHeight(curve=byStartPointEndPoint_2, height=code_block_11, level=levels, wallType=wall_types)
