# Dynamo graph 06startpointMakeWallsFromBSP2File.dyn (Dynamo 2.13.1.3887)

byStartPointEndPoint = Line.ByStartPointEndPoint()  # unwired: startPoint, endPoint
byCoordinates = Point.ByCoordinates()
byCurveAndHeight = Wall.ByCurveAndHeight()  # unwired: curve, height, level, wallType

# group: Data From Excell
file_path = Filename("..\bsp2\AllTogether.xlsx")
file_from_path = FileObject(path=file_path)
code_block = CodeBlock { "Wall"; }
importExcel = Data.ImportExcel(file=file_from_path, sheetName=code_block)

# group: (IGNORE) ~item per index
code_block_2 = CodeBlock { 1; }
python_script = Python(IN[0]=importExcel)  # CPython3
# ---------- python_script.python (26 lines) ----------
# Import necessary libraries
import clr
clr.AddReference("RevitAPI")
from Autodesk.Revit.DB import XYZ
clr.AddReference("RevitNodes")
import Revit
clr.ImportExtensions(Revit.Elements)

# Input data is a list of rows, where each row is a list of x and y coordinates
input_data = IN[0]

# Initialize an empty list to store points
points = []

# Process each row in the input data
for row in input_data:
    # Check if the row has at least two elements (x and y coordinates)
    if len(row) >= 2:
        x = row[0]
        y = row[1]
        # Create a point with the x and y coordinates and add it to the points list
        point = XYZ(x, y, 0)
        points.append(point)

# Output the list of points
OUT = points
# ----------------------------------------
code_block_3 = CodeBlock { 0; }
getItemAtIndex = List.GetItemAtIndex(list=python_script, index=code_block_3)
string_from_array = FromArray(array=getItemAtIndex)
code_block_4 = CodeBlock { ", "; }
split = String.Split(string=string_from_array, separator0=code_block_4)
code_block_5 = CodeBlock(list=split) { list[0]; list[1]; list[2]; }
watch = Watch(code_block_5.out0)
code_block_6 = CodeBlock { 0; }
code_block_7 = CodeBlock { 1; }
remove = String.Remove(string=watch, startIndex=code_block_6, count=code_block_7)
watch_2 = Watch(remove)
watch_3 = Watch(code_block_5.out2)
code_block_8 = CodeBlock { -1; }
code_block_9 = CodeBlock { 1; }
remove_2 = String.Remove(string=watch_3, startIndex=code_block_8, count=code_block_9)
watch_4 = Watch(remove_2)
watch_5 = Watch(code_block_5.out1)
watch_6 = Watch(watch_5)

range = Range()
number_slider = DoubleSlider(1700, range=0..6000 step 100)
number_slider_2 = DoubleSlider(300, range=0..6000 step 100)
byCoordinates_2 = Point.ByCoordinates(x=number_slider, y=number_slider_2)

# group: All X Coords
python_script_2 = Python(IN[0]=importExcel)  # CPython3
# ---------- python_script_2.python (16 lines) ----------
# Load the Python Standard and DesignScript Libraries
import sys
import clr
clr.AddReference('ProtoGeometry')
from Autodesk.DesignScript.Geometry import *

# The inputs to this node will be stored as a list in the IN variables.
dataEnteringNode = IN

dataOutput = list()
# Place your code below this line
for i in IN:
    for j in i:
        dataOutput.append(j[1])
# Assign your output to the OUT variable.
OUT = dataOutput
# ----------------------------------------

# group: All Y Coords
python_script_3 = Python(IN[0]=importExcel)  # CPython3
# ---------- python_script_3.python (16 lines) ----------
# Load the Python Standard and DesignScript Libraries
import sys
import clr
clr.AddReference('ProtoGeometry')
from Autodesk.DesignScript.Geometry import *

# The inputs to this node will be stored as a list in the IN variables.
dataEnteringNode = IN

dataOutput = list()
# Place your code below this line
for i in IN:
    for j in i:
        dataOutput.append(j[0])
# Assign your output to the OUT variable.
OUT = dataOutput
# ----------------------------------------

transpose = List.Transpose(lists=importExcel)
code_block_10 = CodeBlock { 9; 10; 11; 12; 13; 14; }
getItemAtIndex_2 = List.GetItemAtIndex(list=transpose, index=code_block_10.out0)
code_block_11 = CodeBlock { 0; }
removeItemAtIndex = List.RemoveItemAtIndex(list=getItemAtIndex_2, indices=code_block_11)
getItemAtIndex_3 = List.GetItemAtIndex(list=transpose, index=code_block_10.out1)
removeItemAtIndex_2 = List.RemoveItemAtIndex(list=getItemAtIndex_3, indices=code_block_11)
getItemAtIndex_4 = List.GetItemAtIndex(list=transpose, index=code_block_10.out2)
removeItemAtIndex_3 = List.RemoveItemAtIndex(list=getItemAtIndex_4, indices=code_block_11)
byCoordinates_3 = Point.ByCoordinates(x=removeItemAtIndex, y=removeItemAtIndex_2, z=removeItemAtIndex_3)
getItemAtIndex_5 = List.GetItemAtIndex(list=transpose, index=code_block_10.out3)
removeItemAtIndex_4 = List.RemoveItemAtIndex(list=getItemAtIndex_5, indices=code_block_11)
getItemAtIndex_6 = List.GetItemAtIndex(list=transpose, index=code_block_10.out4)
removeItemAtIndex_5 = List.RemoveItemAtIndex(list=getItemAtIndex_6, indices=code_block_11)
getItemAtIndex_7 = List.GetItemAtIndex(list=transpose, index=code_block_10.out5)
removeItemAtIndex_6 = List.RemoveItemAtIndex(list=getItemAtIndex_7, indices=code_block_11)
byCoordinates_4 = Point.ByCoordinates(x=removeItemAtIndex_4, y=removeItemAtIndex_5, z=removeItemAtIndex_6)
byStartPointEndPoint_2 = Line.ByStartPointEndPoint(startPoint=byCoordinates_3, endPoint=byCoordinates_4)
code_block_12 = CodeBlock { 100; }
levels = Levels("Level 0")
wall_types = WallTypes("Curtain_Wall-Empty")
byCurveAndHeight_2 = Wall.ByCurveAndHeight(curve=byStartPointEndPoint_2, height=code_block_12, level=levels, wallType=wall_types)
