# Dynamo graph 07changeonewall.dyn (Dynamo 2.13.1.3887)

code_block = CodeBlock { 1441842; }
element_by_id = ElementById(Id=code_block)
getLocation = Element.GetLocation(element=element_by_id)
code_block_2 = CodeBlock { 2347799; }
element_by_id_2 = ElementById(Id=code_block_2)
getLocation_2 = Element.GetLocation(element=element_by_id_2)
setLocation = Element.SetLocation(element=element_by_id, geometry=getLocation_2)
basePoint = Coordinates.BasePoint()
