# Dynamo graph 08changeOneWallByCertainDistance.dyn (Dynamo 2.13.1.3887)

# group: Element
code_block = CodeBlock { 1441842; }
element_by_id = ElementById(Id=code_block)

# group: Location
getLocation = Element.GetLocation(element=element_by_id)
string_from_object = FromObject(object=getLocation)
watch = Watch(string_from_object)
python_script = Python(IN[0]=watch)  # CPython3
# ---------- python_script.python (22 lines) ----------
# Load the Python Standard and DesignScript Libraries
import sys
import clr
clr.AddReference('ProtoGeometry')
from Autodesk.DesignScript.Geometry import *

# The inputs to this node will be stored as a list in the IN variables.
dataEnteringNode = IN
out = list()

# Place your code below this line


ss = str(IN)
ss = ss.split(" ")

ss3 = ss[10]

     

# Assign your output to the OUT variable.
OUT = ss
# ----------------------------------------
watch_2 = Watch(python_script)

# group: StartPoint X,Y,Z
python_script_2 = Python(IN[0]=watch)  # CPython3
# ---------- python_script_2.python (23 lines) ----------
# Load the Python Standard and DesignScript Libraries
import sys
import clr
clr.AddReference('ProtoGeometry')
from Autodesk.DesignScript.Geometry import *

# The inputs to this node will be stored as a list in the IN variables.
dataEnteringNode = IN
out = list()

# Place your code below this line


ss = str(IN)
ss = ss.split(" ")


ss2 = ss[4]
ss3 = ss2.rstrip(",")
     

# Assign your output to the OUT variable.
OUT = ss3
# ----------------------------------------
watch_3 = Watch(python_script_2)
python_script_3 = Python(IN[0]=watch)  # CPython3
# ---------- python_script_3.python (23 lines) ----------
# Load the Python Standard and DesignScript Libraries
import sys
import clr
clr.AddReference('ProtoGeometry')
from Autodesk.DesignScript.Geometry import *

# The inputs to this node will be stored as a list in the IN variables.
dataEnteringNode = IN
out = list()

# Place your code below this line


ss = str(IN)
ss = ss.split(" ")


ss2 = ss[7]
ss3 = ss2.rstrip(",")
     

# Assign your output to the OUT variable.
OUT = ss3
# ----------------------------------------
watch_4 = Watch(python_script_3)
python_script_4 = Python(IN[0]=watch)  # CPython3
# ---------- python_script_4.python (23 lines) ----------
# Load the Python Standard and DesignScript Libraries
import sys
import clr
clr.AddReference('ProtoGeometry')
from Autodesk.DesignScript.Geometry import *

# The inputs to this node will be stored as a list in the IN variables.
dataEnteringNode = IN
out = list()

# Place your code below this line


ss = str(IN)
ss = ss.split(" ")


ss2 = ss[10]
ss3 = ss2.rstrip("),")
     

# Assign your output to the OUT variable.
OUT = ss3
# ----------------------------------------
watch_5 = Watch(python_script_4)

code_block_2 = CodeBlock { "22036.161"; }
replace = String.Replace(string=watch_3, searchFor=watch_3, replaceWith=code_block_2)

# group: StartPoint
toNumber = String.ToNumber(string=replace)
toNumber_2 = String.ToNumber(string=watch_4)
toNumber_3 = String.ToNumber(string=watch_5)
byCoordinates = Point.ByCoordinates(x=toNumber, y=toNumber_2, z=toNumber_3)

# group: EndPoint X,Y,Z
python_script_5 = Python(IN[0]=watch)  # CPython3
# ---------- python_script_5.python (23 lines) ----------
# Load the Python Standard and DesignScript Libraries
import sys
import clr
clr.AddReference('ProtoGeometry')
from Autodesk.DesignScript.Geometry import *

# The inputs to this node will be stored as a list in the IN variables.
dataEnteringNode = IN
out = list()

# Place your code below this line


ss = str(IN)
ss = ss.split(" ")


ss2 = ss[15]
ss3 = ss2.rstrip(",")
     

# Assign your output to the OUT variable.
OUT = ss3
# ----------------------------------------
watch_6 = Watch(python_script_5)
python_script_6 = Python(IN[0]=watch)  # CPython3
# ---------- python_script_6.python (23 lines) ----------
# Load the Python Standard and DesignScript Libraries
import sys
import clr
clr.AddReference('ProtoGeometry')
from Autodesk.DesignScript.Geometry import *

# The inputs to this node will be stored as a list in the IN variables.
dataEnteringNode = IN
out = list()

# Place your code below this line


ss = str(IN)
ss = ss.split(" ")


ss2 = ss[18]
ss3 = ss2.rstrip(",")
     

# Assign your output to the OUT variable.
OUT = ss3
# ----------------------------------------
watch_7 = Watch(python_script_6)
python_script_7 = Python(IN[0]=watch)  # CPython3
# ---------- python_script_7.python (23 lines) ----------
# Load the Python Standard and DesignScript Libraries
import sys
import clr
clr.AddReference('ProtoGeometry')
from Autodesk.DesignScript.Geometry import *

# The inputs to this node will be stored as a list in the IN variables.
dataEnteringNode = IN
out = list()

# Place your code below this line


ss = str(IN)
ss = ss.split(" ")


ss2 = ss[21]
ss3 = ss2.rstrip("),")
     

# Assign your output to the OUT variable.
OUT = ss3
# ----------------------------------------
watch_8 = Watch(python_script_7)

# group: EndPoint
toNumber_4 = String.ToNumber(string=watch_6)
toNumber_5 = String.ToNumber(string=watch_7)
toNumber_6 = String.ToNumber(string=watch_8)
byCoordinates_2 = Point.ByCoordinates(x=toNumber_4, y=toNumber_5, z=toNumber_6)

byStartPointEndPoint = Line.ByStartPointEndPoint(startPoint=byCoordinates, endPoint=byCoordinates_2)
watch_9 = Watch(byStartPointEndPoint)
setLocation = Element.SetLocation(element=element_by_id, geometry=watch_9)

# group: Vector X,Y,Z
python_script_8 = Python(IN[0]=watch)  # CPython3
# ---------- python_script_8.python (23 lines) ----------
# Load the Python Standard and DesignScript Libraries
import sys
import clr
clr.AddReference('ProtoGeometry')
from Autodesk.DesignScript.Geometry import *

# The inputs to this node will be stored as a list in the IN variables.
dataEnteringNode = IN
out = list()

# Place your code below this line


ss = str(IN)
ss = ss.split(" ")


ss2 = ss[32]
ss3 = ss2.rstrip(",")
     

# Assign your output to the OUT variable.
OUT = ss3
# ----------------------------------------
watch_10 = Watch(python_script_8)
python_script_9 = Python(IN[0]=watch)  # CPython3
# ---------- python_script_9.python (23 lines) ----------
# Load the Python Standard and DesignScript Libraries
import sys
import clr
clr.AddReference('ProtoGeometry')
from Autodesk.DesignScript.Geometry import *

# The inputs to this node will be stored as a list in the IN variables.
dataEnteringNode = IN
out = list()

# Place your code below this line


ss = str(IN)
ss = ss.split(" ")


ss2 = ss[29]
ss3 = ss2.rstrip(",")
     

# Assign your output to the OUT variable.
OUT = ss3
# ----------------------------------------
watch_11 = Watch(python_script_9)
python_script_10 = Python(IN[0]=watch)  # CPython3
# ---------- python_script_10.python (23 lines) ----------
# Load the Python Standard and DesignScript Libraries
import sys
import clr
clr.AddReference('ProtoGeometry')
from Autodesk.DesignScript.Geometry import *

# The inputs to this node will be stored as a list in the IN variables.
dataEnteringNode = IN
out = list()

# Place your code below this line


ss = str(IN)
ss = ss.split(" ")


ss2 = ss[26]
ss3 = ss2.rstrip(",")
     

# Assign your output to the OUT variable.
OUT = ss3
# ----------------------------------------
watch_12 = Watch(python_script_10)

# group: Length
python_script_11 = Python(IN[0]=watch)  # CPython3
# ---------- python_script_11.python (23 lines) ----------
# Load the Python Standard and DesignScript Libraries
import sys
import clr
clr.AddReference('ProtoGeometry')
from Autodesk.DesignScript.Geometry import *

# The inputs to this node will be stored as a list in the IN variables.
dataEnteringNode = IN
out = list()

# Place your code below this line


ss = str(IN)
ss = ss.split(" ")


ss2 = ss[35]
ss3 = ss2.rstrip("))']")
     

# Assign your output to the OUT variable.
OUT = ss3
# ----------------------------------------
watch_13 = Watch(python_script_11)

watch_14 = Watch(string_from_object)
