# Dynamo graph 09ERRORchangeAllWalls.dyn "09changeAllWalls" (Dynamo 2.13.1.3887)
# packages: archi-lab.net 2023.213.1622

# group: Import CSV file
file_path = Filename(".\test.csv")
importCSV = Data.ImportCSV(filePath=file_path)
code_block = CodeBlock { "78_firstfloor_walls"; }

# group: Tag Xmin Ymin | list of values
code_block_2 = CodeBlock { 0; 1; 2; 4; 5; }
getItemAtIndex = List.GetItemAtIndex(list=importCSV, index=code_block_2.out1)
getItemAtIndex_2 = List.GetItemAtIndex(list=importCSV, index=code_block_2.out2)
getItemAtIndex_3 = List.GetItemAtIndex(list=importCSV, index=code_block_2.out0)
watch = Watch(getItemAtIndex_3)
watch_2 = Watch(getItemAtIndex_2)
watch_3 = Watch(getItemAtIndex)

code_block_3 = CodeBlock { 0; }
removeItemAtIndex = List.RemoveItemAtIndex(list=getItemAtIndex, indices=code_block_3)
code_block_4 = CodeBlock { 0; }
code_block_5 = CodeBlock { 0; }
removeItemAtIndex_2 = List.RemoveItemAtIndex(list=getItemAtIndex_2, indices=code_block_5)
code_block_6 = CodeBlock { 1000; }

# group: Sx Ex
mul = removeItemAtIndex_2 * code_block_6
mul_2 = removeItemAtIndex * code_block_6

code_block_7 = CodeBlock { null; }
firstIndexOf = List.FirstIndexOf(list=mul, item=code_block_7)
slice = List.Slice(list=removeItemAtIndex, start=code_block_4, end=firstIndexOf)
python_script = Python(IN[0]=slice)  # CPython3
# ---------- python_script.python (20 lines) ----------
# Load the Python Standard and DesignScript Libraries
import sys
import clr
clr.AddReference('ProtoGeometry')
from Autodesk.DesignScript.Geometry import *

# The inputs to this node will be stored as a list in the IN variables.
dataEnteringNode = IN

# Place your code below this line
j = 0
olist = list()
ftoint = IN
for i in ftoint:
    for j in i:
        k=int(j)
        olist.append(k)

# Assign your output to the OUT variable.
OUT = olist
# ----------------------------------------
slice_2 = List.Slice(list=mul, start=code_block_4, end=firstIndexOf)
python_script_2 = Python(IN[0]=slice_2)  # CPython3; same code as python_script
byCoordinates = Point.ByCoordinates(x=python_script, y=python_script_2)
byCoordinates_2 = Point.ByCoordinates()
byStartPointEndPoint = Line.ByStartPointEndPoint(startPoint=byCoordinates, endPoint=byCoordinates_2)
setLocation = Element.SetLocation(geometry=byStartPointEndPoint)  # unwired: element
byStartPointEndPoint_2 = Line.ByStartPointEndPoint()  # unwired: startPoint, endPoint
byCoordinates_3 = Point.ByCoordinates()
byCurveAndHeight = Wall.ByCurveAndHeight()  # unwired: curve, height, level, wallType
range = Range()
getLocation = Element.GetLocation()  # unwired: element
transpose = List.Transpose()  # unwired: lists
code_block_8 = CodeBlock { 0; }
removeItemAtIndex_3 = List.RemoveItemAtIndex(list=getItemAtIndex_3, indices=code_block_8)
slice_3 = List.Slice(list=removeItemAtIndex_3, start=code_block_4, end=firstIndexOf)
element_by_id = ElementById(Id=slice_3)
getLocation_2 = Element.GetLocation(element=element_by_id)
exteriorDirection = Custom[Wall.ExteriorDirection](wall=element_by_id)  # package archi-lab.net; This node returns exterior direction of the wall as a vector.
location = archilab.Revit.Elements.Elements.Location(element=element_by_id)
getLocation_3 = Element.GetLocation(element=element_by_id)

# group: Stairs parameters
parameters = Element.Parameters(element=element_by_id)
watch_4 = Watch(parameters)

code_block_9 = CodeBlock { "Type ID"; }
getParameterValueByName = Element.GetParameterValueByName(parameterName=code_block_9)  # unwired: element
value = Parameter.Value()  # unwired: parameter
watch_5 = Watch(python_script)
getItemAtIndex_4 = List.GetItemAtIndex(list=importCSV, index=code_block_2.out3)
watch_6 = Watch(getItemAtIndex_2)
code_block_10 = CodeBlock { 0; }
removeItemAtIndex_4 = List.RemoveItemAtIndex(list=watch_6, indices=code_block_10)
getItemAtIndex_5 = List.GetItemAtIndex(list=importCSV, index=code_block_2.out4)
watch_7 = Watch(getItemAtIndex_5)
code_block_11 = CodeBlock { 0; }
removeItemAtIndex_5 = List.RemoveItemAtIndex(list=watch_7, indices=code_block_11)
watch_8 = Watch()  # unwired: arg0
watch_9 = Watch()  # unwired: arg0
watch_10 = Watch()  # unwired: arg0
watch_11 = Watch()  # unwired: arg0
watch_12 = Watch()  # unwired: arg0
