# Dynamo graph 10dislogeWallsByAbsoluteDistance.dyn (Dynamo 2.13.1.3887)

# group: Getting the values
file_path = Filename("10files\changed_values.xlsx")
file_from_path = FileObject(path=file_path)
code_block = CodeBlock { "Wall"; }
importExcel = Data.ImportExcel(file=file_from_path, sheetName=code_block)
transpose = List.Transpose(lists=importExcel)
code_block_2 = CodeBlock { 9; 10; 12; 13; 15; 16; }
getItemAtIndex = List.GetItemAtIndex(list=transpose, index=code_block_2.out2)
watch = Watch(getItemAtIndex)
getItemAtIndex_2 = List.GetItemAtIndex(list=transpose, index=code_block_2.out1)
watch_2 = Watch(getItemAtIndex_2)
getItemAtIndex_3 = List.GetItemAtIndex(list=transpose, index=code_block_2.out0)
watch_3 = Watch(getItemAtIndex_3)
getItemAtIndex_4 = List.GetItemAtIndex(list=transpose, index=code_block_2.out3)
watch_4 = Watch(getItemAtIndex_4)
getItemAtIndex_5 = List.GetItemAtIndex(list=transpose, index=code_block_2.out4)
getItemAtIndex_6 = List.GetItemAtIndex(list=transpose, index=code_block_2.out5)
watch_5 = Watch(getItemAtIndex_6)
watch_6 = Watch(getItemAtIndex_5)

code_block_3 = CodeBlock { 0; }

# group: Original StartPoint xy
removeItemAtIndex = List.RemoveItemAtIndex(list=getItemAtIndex_3, indices=code_block_3)
watch_7 = Watch(removeItemAtIndex)
removeItemAtIndex_2 = List.RemoveItemAtIndex(list=getItemAtIndex_2, indices=code_block_3)
watch_8 = Watch(removeItemAtIndex_2)

# group: Original EndPoint xy
removeItemAtIndex_3 = List.RemoveItemAtIndex(list=getItemAtIndex, indices=code_block_3)
watch_9 = Watch(removeItemAtIndex_3)
removeItemAtIndex_4 = List.RemoveItemAtIndex(list=getItemAtIndex_4, indices=code_block_3)
watch_10 = Watch(removeItemAtIndex_4)

# group: Selecting elements to displace
file_path_2 = Filename("10files\original_values.xlsx")
file_from_path_2 = FileObject(path=file_path_2)
code_block_4 = CodeBlock { "Wall"; }
importExcel_2 = Data.ImportExcel(file=file_from_path_2, sheetName=code_block_4)
transpose_2 = List.Transpose(lists=importExcel_2)
code_block_5 = CodeBlock { 3; }
getItemAtIndex_7 = List.GetItemAtIndex(list=transpose_2, index=code_block_5)
code_block_6 = CodeBlock { 0; }
removeItemAtIndex_5 = List.RemoveItemAtIndex(list=getItemAtIndex_7, indices=code_block_6)
watch_11 = Watch(getItemAtIndex_7)
watch_12 = Watch(removeItemAtIndex_5)

# group: Double to Int
python_script = Python(IN[0]=removeItemAtIndex_5)  # CPython3
# ---------- python_script.python (17 lines) ----------
# Load the Python Standard and DesignScript Libraries
import sys
import clr
clr.AddReference('ProtoGeometry')
from Autodesk.DesignScript.Geometry import *

# The inputs to this node will be stored as a list in the IN variables.
dataEnteringNode = IN
j = 0
olist = list()
# Place your code below this line
for i in IN:
    for j in i:
        k = int(j)
        olist.append(k)
# Assign your output to the OUT variable.
OUT = olist
# ----------------------------------------
watch_13 = Watch(python_script)

# group (continued): Selecting elements to displace
element_by_id = ElementById(Id=python_script)

# group: Edited StartPoint xy
removeItemAtIndex_6 = List.RemoveItemAtIndex(list=getItemAtIndex_5, indices=code_block_3)
removeItemAtIndex_7 = List.RemoveItemAtIndex(list=getItemAtIndex_6, indices=code_block_3)
watch_14 = Watch(removeItemAtIndex_7)
watch_15 = Watch(removeItemAtIndex_6)

sub = removeItemAtIndex_6 - removeItemAtIndex
add = sub + removeItemAtIndex_3
sub_2 = removeItemAtIndex_7 - removeItemAtIndex_2
add_2 = sub_2 + watch_10

# group: EDITED startxy endxy
watch_16 = Watch(removeItemAtIndex_6)
watch_17 = Watch(removeItemAtIndex_7)
watch_18 = Watch(add)
watch_19 = Watch(add_2)
watch_20 = Watch(removeItemAtIndex)
watch_21 = Watch(removeItemAtIndex_2)
watch_22 = Watch(removeItemAtIndex_3)
watch_23 = Watch(removeItemAtIndex_4)

byCoordinates = Point.ByCoordinates(x=watch_16, y=watch_17)
byCoordinates_2 = Point.ByCoordinates(x=watch_18, y=watch_19)
byStartPointEndPoint = Line.ByStartPointEndPoint(startPoint=byCoordinates, endPoint=byCoordinates_2)
setLocation = Element.SetLocation(element=element_by_id, geometry=byStartPointEndPoint)
getLocation = Element.GetLocation()  # unwired: element
