# Dynamo graph 12dislodgeWithOrientationLength.dyn (Dynamo 2.13.1.3887)

file_path = Filename("12files\AllTogether.xlsx")
file_from_path = FileObject(path=file_path)
code_block = CodeBlock { "Wall"; }
importExcel = Data.ImportExcel(file=file_from_path, sheetName=code_block)
transpose = List.Transpose(lists=importExcel)
code_block_2 = CodeBlock { 15; 16; 9; 10; 12; 13; }
getItemAtIndex = List.GetItemAtIndex(list=transpose, index=code_block_2.out1)
watch = Watch(getItemAtIndex)
getItemAtIndex_2 = List.GetItemAtIndex(list=transpose, index=code_block_2.out0)
watch_2 = Watch(getItemAtIndex_2)
code_block_3 = CodeBlock { 0; }
removeItemAtIndex = List.RemoveItemAtIndex(list=getItemAtIndex_2, indices=code_block_3)
watch_3 = Watch(removeItemAtIndex)
removeItemAtIndex_2 = List.RemoveItemAtIndex(list=getItemAtIndex, indices=code_block_3)
watch_4 = Watch(removeItemAtIndex_2)
file_path_2 = Filename("10files\original_values.xlsx")
file_from_path_2 = FileObject(path=file_path_2)
code_block_4 = CodeBlock { "Wall"; }
importExcel_2 = Data.ImportExcel(file=file_from_path_2, sheetName=code_block_4)
transpose_2 = List.Transpose(lists=importExcel_2)
code_block_5 = CodeBlock { 3; }
getItemAtIndex_3 = List.GetItemAtIndex(list=transpose_2, index=code_block_5)
code_block_6 = CodeBlock { 0; }
removeItemAtIndex_3 = List.RemoveItemAtIndex(list=getItemAtIndex_3, indices=code_block_6)

# group: Double to Int
python_script = Python(IN[0]=removeItemAtIndex_3)  # CPython3
# ---------- python_script.python (17 lines) ----------
# Load the Python Standard and DesignScript Libraries
import sys
import clr
clr.AddReference('ProtoGeometry')
from Autodesk.DesignScript.Geometry import *

# The inputs to this node will be stored as a list in the IN variables.
dataEnteringNode = IN
j = 0
olist = list()
# Place your code below this line
for i in IN:
    for j in i:
        k = int(j)
        olist.append(k)
# Assign your output to the OUT variable.
OUT = olist
# ----------------------------------------
watch_5 = Watch(python_script)

element_by_id = ElementById(Id=python_script)
getItemAtIndex_4 = List.GetItemAtIndex(list=transpose, index=code_block_2.out2)
removeItemAtIndex_4 = List.RemoveItemAtIndex(list=getItemAtIndex_4, indices=code_block_3)
getItemAtIndex_5 = List.GetItemAtIndex(list=transpose, index=code_block_2.out3)
removeItemAtIndex_5 = List.RemoveItemAtIndex(list=getItemAtIndex_5, indices=code_block_3)
byCoordinates = Point.ByCoordinates(x=removeItemAtIndex_4, y=removeItemAtIndex_5)
code_block_7 = CodeBlock { true; }
byCoordinates_2 = Vector.ByCoordinates(x=removeItemAtIndex, y=removeItemAtIndex_2, normalized=code_block_7)
byStartPointDirectionLength = Line.ByStartPointDirectionLength(startPoint=byCoordinates, direction=byCoordinates_2)
setLocation = Element.SetLocation(element=element_by_id, geometry=byStartPointDirectionLength)
getLocation = Element.GetLocation()  # unwired: element
watch_6 = Watch(getItemAtIndex_3)
watch_7 = Watch(removeItemAtIndex_3)
watch_8 = Watch(getItemAtIndex_4)
watch_9 = Watch(getItemAtIndex_5)
watch_10 = Watch(removeItemAtIndex_5)
watch_11 = Watch(removeItemAtIndex_4)
