# Dynamo graph 13dislogeWallsByRelativeDistance.dyn (Dynamo 2.13.1.3887)
# packages: Clockwork for Dynamo 2.x 2.4.0

file_path = Filename("13files\relative_values.xlsx")
file_from_path = FileObject(path=file_path)
code_block = CodeBlock { "Wall"; }
importExcel = Data.ImportExcel(file=file_from_path, sheetName=code_block)
translate = Geometry.Translate()  # unwired: geometry, direction
translate_2 = Geometry.Translate()  # unwired: geometry, direction, distance
code_block_2 = CodeBlock { 1441841; }
byID = Custom[Element.ByID](IdOrUniqueId=code_block_2)  # package Clockwork for Dynamo 2.x; Gets the Revit element(s) for a list of IDs (or a single ID). Optionally retrieves elements from linked documents as well.
location = Custom[Element.Location+](element=byID)  # package Clockwork for Dynamo 2.x; Returns the location of an element as point, curve or curve loop, along with some booleans to help filtering the results. Unlike the OOTB Element.GetLocation node, it also retunrs sketch lines of sketch-based elements like floor slabs as well as the element's rotation property.
number_slider = DoubleSlider(68, range=0..1500 step 0.1)
translate_3 = Geometry.Translate(geometry=location.curves, xTranslation=number_slider)
setLocation = Element.SetLocation(element=byID, geometry=translate_3)
