# Dynamo graph 14TranslationRelative.dyn (Dynamo 2.13.1.3887)
# packages: Clockwork for Dynamo 2.x 2.4.0

translate = Geometry.Translate()  # unwired: geometry, direction
translate_2 = Geometry.Translate()  # unwired: geometry, direction, distance
file_path = Filename("14files\relative_values.xlsx")
file_from_path = FileObject(path=file_path)
code_block = CodeBlock { "Wall"; }
importExcel = Data.ImportExcel(file=file_from_path, sheetName=code_block)
transpose = List.Transpose(lists=importExcel)
code_block_2 = CodeBlock { 3; }
getItemAtIndex = List.GetItemAtIndex(list=transpose, index=code_block_2)
code_block_3 = CodeBlock { 0; }
removeItemAtIndex = List.RemoveItemAtIndex(list=getItemAtIndex, indices=code_block_3)

# group: Double to Int
python_script = Python(IN[0]=removeItemAtIndex)  # CPython3
# ---------- python_script.python (17 lines) ----------
# Load the Python Standard and DesignScript Libraries
import sys
import clr
clr.AddReference('ProtoGeometry')
from Autodesk.DesignScript.Geometry import *

# The inputs to this node will be stored as a list in the IN variables.
dataEnteringNode = IN
j = 0
olist = list()
# Place your code below this line
for i in IN:
    for j in i:
        k = int(j)
        olist.append(k)
# Assign your output to the OUT variable.
OUT = olist
# ----------------------------------------
watch = Watch(python_script)

element_by_id = ElementById(Id=python_script)
location = Custom[Element.Location+](element=element_by_id)  # package Clockwork for Dynamo 2.x; Returns the location of an element as point, curve or curve loop, along with some booleans to help filtering the results. Unlike the OOTB Element.GetLocation node, it also retunrs sketch lines of sketch-based elements like floor slabs as well as the element's rotation property.
file_path_2 = Filename("14files\relative_values.xlsx")
file_from_path_2 = FileObject(path=file_path_2)
code_block_4 = CodeBlock { "Wall"; }
importExcel_2 = Data.ImportExcel(file=file_from_path_2, sheetName=code_block_4)
transpose_2 = List.Transpose(lists=importExcel_2)
code_block_5 = CodeBlock { 15; 16; 9; 10; 12; 13; }
getItemAtIndex_2 = List.GetItemAtIndex(list=transpose_2, index=code_block_5.out0)
code_block_6 = CodeBlock { 0; }
removeItemAtIndex_2 = List.RemoveItemAtIndex(list=getItemAtIndex_2, indices=code_block_6)
getItemAtIndex_3 = List.GetItemAtIndex(list=transpose_2, index=code_block_5.out1)
removeItemAtIndex_3 = List.RemoveItemAtIndex(list=getItemAtIndex_3, indices=code_block_6)
translate_3 = Geometry.Translate(geometry=location.curves, xTranslation=removeItemAtIndex_2, yTranslation=removeItemAtIndex_3)
setLocation = Element.SetLocation(element=element_by_id, geometry=translate_3)
code_block_7 = CodeBlock { 1441841; }
byID = Custom[Element.ByID](IdOrUniqueId=code_block_7)  # package Clockwork for Dynamo 2.x; Gets the Revit element(s) for a list of IDs (or a single ID). Optionally retrieves elements from linked documents as well.
number_slider = DoubleSlider(68, range=0..1500 step 0.1)
watch_2 = Watch(removeItemAtIndex)
setLocation_2 = Element.SetLocation(element=element_by_id)  # unwired: geometry
watch_3 = Watch(getItemAtIndex)
watch_4 = Watch(getItemAtIndex_3)
watch_5 = Watch(getItemAtIndex_2)
watch_6 = Watch(removeItemAtIndex_2)
watch_7 = Watch(removeItemAtIndex_3)
