# Dynamo graph 15ChangeOneWallDirection.dyn (Dynamo 2.13.1.3887)
# packages: Clockwork for Dynamo 2.x 2.4.0, archi-lab.net 2023.213.1622

file_path = Filename("15files\AllTogether.xlsx")
file_from_path = FileObject(path=file_path)
code_block = CodeBlock { "Wall"; }
importExcel = Data.ImportExcel(file=file_from_path, sheetName=code_block)
transpose = List.Transpose(lists=importExcel)
code_block_2 = CodeBlock { 3; }
getItemAtIndex = List.GetItemAtIndex(list=transpose, index=code_block_2)
code_block_3 = CodeBlock { 0; }
removeItemAtIndex = List.RemoveItemAtIndex(list=getItemAtIndex, indices=code_block_3)

# group: Double to Int
python_script = Python(IN[0]=removeItemAtIndex)  # CPython3
# ---------- python_script.python (17 lines) ----------
# Load the Python Standard and DesignScript Libraries
import sys
import clr
clr.AddReference('ProtoGeometry')
from Autodesk.DesignScript.Geometry import *

# The inputs to this node will be stored as a list in the IN variables.
dataEnteringNode = IN
j = 0
olist = list()
# Place your code below this line
for i in IN:
    for j in i:
        k = int(j)
        olist.append(k)
# Assign your output to the OUT variable.
OUT = olist
# ----------------------------------------
watch = Watch(python_script)

element_by_id = ElementById(Id=python_script)
location = Custom[Element.Location+](element=element_by_id)  # package Clockwork for Dynamo 2.x; Returns the location of an element as point, curve or curve loop, along with some booleans to help filtering the results. Unlike the OOTB Element.GetLocation node, it also retunrs sketch lines of sketch-based elements like floor slabs as well as the element's rotation property.
translate = Geometry.Translate()  # unwired: geometry, direction, distance
getLocation = Element.GetLocation(element=element_by_id)
location_2 = Custom[Element.Location+](element=element_by_id)
startPoint = Curve.StartPoint(curve=location_2.curves)
ZAxis = Vector.ZAxis()
code_block_4 = CodeBlock { 10; }
rotate = Geometry.Rotate(geometry=getLocation, origin=startPoint, axis=ZAxis, degrees=code_block_4)
setLocation = Element.SetLocation(element=element_by_id, geometry=rotate)
code_block_5 = CodeBlock { 1441841; }
byID = Custom[Element.ByID](IdOrUniqueId=code_block_5)  # package Clockwork for Dynamo 2.x; Gets the Revit element(s) for a list of IDs (or a single ID). Optionally retrieves elements from linked documents as well.
watch_2 = Watch(removeItemAtIndex)
setLocation_2 = Element.SetLocation()  # unwired: element, geometry
watch_3 = Watch(getItemAtIndex)
file_from_path_2 = FileObject(path=file_path)
code_block_6 = CodeBlock { "Wall"; }
importExcel_2 = Data.ImportExcel(file=file_from_path_2, sheetName=code_block_6)
transpose_2 = List.Transpose(lists=importExcel_2)
code_block_7 = CodeBlock { 15; 16; 9; 10; 17; }
getItemAtIndex_2 = List.GetItemAtIndex(list=transpose_2, index=code_block_7.out1)
watch_4 = Watch(getItemAtIndex_2)
getItemAtIndex_3 = List.GetItemAtIndex(list=transpose_2, index=code_block_7.out0)
watch_5 = Watch(getItemAtIndex_3)
translate_2 = Geometry.Translate()  # unwired: geometry, direction
getItemAtIndex_4 = List.GetItemAtIndex(list=transpose_2, index=code_block_7.out2)
watch_6 = Watch(getItemAtIndex_4)
code_block_8 = CodeBlock { 0; }
removeItemAtIndex_2 = List.RemoveItemAtIndex(list=getItemAtIndex_4, indices=code_block_8)
watch_7 = Watch(removeItemAtIndex_2)
getItemAtIndex_5 = List.GetItemAtIndex(list=transpose_2, index=code_block_7.out3)
watch_8 = Watch(getItemAtIndex_5)
removeItemAtIndex_3 = List.RemoveItemAtIndex(list=getItemAtIndex_4, indices=code_block_8)
watch_9 = Watch(removeItemAtIndex_3)
transform = Geometry.Transform()  # unwired: geometry, cs
transform_2 = Geometry.Transform()  # unwired: geometry, fromCoordinateSystem, contextCoordinateSystem
transform_origin = Custom[Transform Origin]()  # package archi-lab.net; This node will query an element for its Transform (Coordinate System) and then return its Origin point.; unwired: element
removeItemAtIndex_4 = List.RemoveItemAtIndex(list=getItemAtIndex_3, indices=code_block_8)
watch_10 = Watch(removeItemAtIndex_4)
removeItemAtIndex_5 = List.RemoveItemAtIndex(list=getItemAtIndex_2, indices=code_block_8)
watch_11 = Watch(removeItemAtIndex_5)
byCoordinates = Vector.ByCoordinates(x=watch_10, y=watch_11)
XAxis = Vector.XAxis()
code_block_9 = CodeBlock { 69; }
rotate_2 = Vector.Rotate(vector=byCoordinates, axis=XAxis, degrees=code_block_9)
translate_3 = Geometry.Translate(geometry=getLocation, direction=rotate_2)
toPoint = Custom[Transform.ToPoint](point=translate_3)  # package archi-lab.net; This node takes a Transform and an input point that will be translated by the Transform.; unwired: transform
byCoordinates_2 = Point.ByCoordinates(x=removeItemAtIndex_2, y=removeItemAtIndex_3)
getItemAtIndex_6 = List.GetItemAtIndex(list=transpose_2, index=code_block_7.out4)
removeItemAtIndex_6 = List.RemoveItemAtIndex(list=getItemAtIndex_6, indices=code_block_8)
byStartPointDirectionLength = Line.ByStartPointDirectionLength(startPoint=byCoordinates_2, direction=byCoordinates, length=removeItemAtIndex_6)
watch_12 = Watch(element_by_id)
length = Vector.Length(vector=byCoordinates)
watch_13 = Watch(getItemAtIndex_6)
watch_14 = Watch(removeItemAtIndex_6)
exteriorDirection = Custom[Wall.ExteriorDirection](wall=element_by_id)  # package archi-lab.net; This node returns exterior direction of the wall as a vector.
exteriorAngle = Custom[Angle.ExteriorAngle](angle=element_by_id)  # package Clockwork for Dynamo 2.x; Computes the exterior angle of a given angle.
orientation = Custom[Wall.Orientation](wall=element_by_id)  # package Clockwork for Dynamo 2.x; Gets the orientation of a given wall instance (normal of the exterior face of the wall). Will *not* work for walls hosted on mass faces or in-place walls.
X = Vector.X(vector=rotate_2)
Y = Vector.Y(vector=rotate_2)
Z = Vector.Z(vector=rotate_2)
X_2 = Vector.X(vector=byCoordinates)
Y_2 = Vector.Y(vector=byCoordinates)
Z_2 = Vector.Z(vector=byCoordinates)
integer_slider = IntegerSlider(0, range=0..100 step 1)
integer_slider_2 = IntegerSlider(0, range=0..100 step 1)
integer_slider_3 = IntegerSlider(0, range=0..100 step 1)
byCoordinates_3 = Point.ByCoordinates(x=integer_slider, y=integer_slider_2, z=integer_slider_3)
byCoordinates_4 = Vector.ByCoordinates(x=integer_slider, y=integer_slider_2, z=integer_slider_3)
length_2 = Vector.Length(vector=byCoordinates_4)
byStartPointDirectionLength_2 = Line.ByStartPointDirectionLength(startPoint=byCoordinates_3, direction=byCoordinates_4, length=length_2)
translate_4 = Geometry.Translate(geometry=byStartPointDirectionLength_2)  # unwired: direction
toPoint_2 = Custom[Transform.ToPoint]()  # unwired: transform, point
direction = Line.Direction()  # unwired: line
rotate_3 = Geometry.Rotate()  # unwired: geometry, origin, axis
XAxis_2 = Vector.XAxis()
code_block_10 = CodeBlock { 82; }
rotate_4 = Vector.Rotate(vector=byCoordinates_4, axis=XAxis_2, degrees=code_block_10)
byStartPointDirectionLength_3 = Line.ByStartPointDirectionLength(startPoint=byCoordinates_3, direction=rotate_4, length=length_2)
setLocation_3 = Element.SetLocation()  # unwired: element, geometry
transform_3 = Geometry.Transform()  # unwired: geometry, fromCoordinateSystem, contextCoordinateSystem
transform_origin_2 = Custom[Transform Origin]()  # unwired: element
Y_3 = Vector.Y(vector=rotate_4)
Z_3 = Vector.Z(vector=rotate_4)
X_3 = Vector.X(vector=rotate_4)
X_4 = Vector.X(vector=byCoordinates_4)
Y_4 = Vector.Y(vector=byCoordinates_4)
Z_4 = Vector.Z(vector=byCoordinates_4)
translate_5 = Geometry.Translate()  # unwired: geometry, direction, distance
transform_4 = Geometry.Transform()  # unwired: geometry, cs
wall_location = WallLocation()  # nothing selected
orientation_2 = Custom[Wall.Orientation](wall=element_by_id)
orientation_3 = Custom[Wall.Orientation]()  # unwired: wall
watch_15 = Watch(location_2.curveEndpoints)
YAxis = Vector.YAxis()
watch_16 = Watch(rotate)
watch_17 = Watch(location_2.curves)
