# Dynamo graph 15TranslationDirection.dyn (Dynamo 2.13.1.3887)
# packages: Clockwork for Dynamo 2.x 2.4.0, archi-lab.net 2023.213.1622

file_path = Filename("14files\relative_values.xlsx")
file_from_path = FileObject(path=file_path)
code_block = CodeBlock { "Wall"; }
importExcel = Data.ImportExcel(file=file_from_path, sheetName=code_block)
transpose = List.Transpose(lists=importExcel)
code_block_2 = CodeBlock { 3; }
getItemAtIndex = List.GetItemAtIndex(list=transpose, index=code_block_2)
code_block_3 = CodeBlock { 0; }
removeItemAtIndex = List.RemoveItemAtIndex(list=getItemAtIndex, indices=code_block_3)

# group: Double to Int
python_script = Python(IN[0]=removeItemAtIndex)  # CPython3
# ---------- python_script.python (17 lines) ----------
# Load the Python Standard and DesignScript Libraries
import sys
import clr
clr.AddReference('ProtoGeometry')
from Autodesk.DesignScript.Geometry import *

# The inputs to this node will be stored as a list in the IN variables.
dataEnteringNode = IN
j = 0
olist = list()
# Place your code below this line
for i in IN:
    for j in i:
        k = int(j)
        olist.append(k)
# Assign your output to the OUT variable.
OUT = olist
# ----------------------------------------
watch = Watch(python_script)

element_by_id = ElementById(Id=python_script)
location = Custom[Element.Location+](element=element_by_id)  # package Clockwork for Dynamo 2.x; Returns the location of an element as point, curve or curve loop, along with some booleans to help filtering the results. Unlike the OOTB Element.GetLocation node, it also retunrs sketch lines of sketch-based elements like floor slabs as well as the element's rotation property.
translate = Geometry.Translate()  # unwired: geometry, direction, distance
getLocation = Element.GetLocation(element=element_by_id)
file_path_2 = Filename("15files\AllTogether.xlsx")
file_from_path_2 = FileObject(path=file_path_2)
code_block_4 = CodeBlock { "Wall"; }
importExcel_2 = Data.ImportExcel(file=file_from_path_2, sheetName=code_block_4)
transpose_2 = List.Transpose(lists=importExcel_2)
code_block_5 = CodeBlock { 15; 16; 9; 10; 17; }
getItemAtIndex_2 = List.GetItemAtIndex(list=transpose_2, index=code_block_5.out0)
code_block_6 = CodeBlock { 0; }
removeItemAtIndex_2 = List.RemoveItemAtIndex(list=getItemAtIndex_2, indices=code_block_6)
watch_2 = Watch(removeItemAtIndex_2)
getItemAtIndex_3 = List.GetItemAtIndex(list=transpose_2, index=code_block_5.out1)
removeItemAtIndex_3 = List.RemoveItemAtIndex(list=getItemAtIndex_3, indices=code_block_6)
watch_3 = Watch(removeItemAtIndex_3)
byCoordinates = Vector.ByCoordinates(x=watch_2, y=watch_3)
XAxis = Vector.XAxis()
code_block_7 = CodeBlock { 69; }
rotate = Vector.Rotate(vector=byCoordinates, axis=XAxis, degrees=code_block_7)
translate_2 = Geometry.Translate(geometry=getLocation, direction=rotate)
setLocation = Element.SetLocation(element=element_by_id, geometry=translate_2)
code_block_8 = CodeBlock { 1441841; }
byID = Custom[Element.ByID](IdOrUniqueId=code_block_8)  # package Clockwork for Dynamo 2.x; Gets the Revit element(s) for a list of IDs (or a single ID). Optionally retrieves elements from linked documents as well.
watch_4 = Watch(removeItemAtIndex)
setLocation_2 = Element.SetLocation()  # unwired: element, geometry
watch_5 = Watch(getItemAtIndex)
watch_6 = Watch(getItemAtIndex_3)
watch_7 = Watch(getItemAtIndex_2)
translate_3 = Geometry.Translate()  # unwired: geometry, direction
getItemAtIndex_4 = List.GetItemAtIndex(list=transpose_2, index=code_block_5.out2)
watch_8 = Watch(getItemAtIndex_4)
removeItemAtIndex_4 = List.RemoveItemAtIndex(list=getItemAtIndex_4, indices=code_block_6)
watch_9 = Watch(removeItemAtIndex_4)
getItemAtIndex_5 = List.GetItemAtIndex(list=transpose_2, index=code_block_5.out3)
watch_10 = Watch(getItemAtIndex_5)
removeItemAtIndex_5 = List.RemoveItemAtIndex(list=getItemAtIndex_4, indices=code_block_6)
watch_11 = Watch(removeItemAtIndex_5)
transform = Geometry.Transform()  # unwired: geometry, cs
transform_2 = Geometry.Transform()  # unwired: geometry, fromCoordinateSystem, contextCoordinateSystem
transform_origin = Custom[Transform Origin]()  # package archi-lab.net; This node will query an element for its Transform (Coordinate System) and then return its Origin point.; unwired: element
toPoint = Custom[Transform.ToPoint]()  # package archi-lab.net; This node takes a Transform and an input point that will be translated by the Transform.; unwired: transform, point
byCoordinates_2 = Point.ByCoordinates(x=removeItemAtIndex_4, y=removeItemAtIndex_5)
getItemAtIndex_6 = List.GetItemAtIndex(list=transpose_2, index=code_block_5.out4)
removeItemAtIndex_6 = List.RemoveItemAtIndex(list=getItemAtIndex_6, indices=code_block_6)
byStartPointDirectionLength = Line.ByStartPointDirectionLength(startPoint=byCoordinates_2, direction=byCoordinates, length=removeItemAtIndex_6)
watch_12 = Watch(element_by_id)
length = Vector.Length(vector=byCoordinates)
watch_13 = Watch(getItemAtIndex_6)
watch_14 = Watch(removeItemAtIndex_6)
