# Dynamo graph 16ChangeDirectionVectors.dyn (Dynamo 2.13.1.3887)
# packages: archi-lab.net 2023.213.1622

translate = Geometry.Translate()  # unwired: geometry, direction, distance
setLocation = Element.SetLocation()  # unwired: element, geometry
integer_slider = IntegerSlider(6, range=0..100 step 1)
integer_slider_2 = IntegerSlider(13, range=0..100 step 1)
integer_slider_3 = IntegerSlider(7, range=0..100 step 1)
byCoordinates = Point.ByCoordinates(x=integer_slider, y=integer_slider_2, z=integer_slider_3)
byCoordinates_2 = Vector.ByCoordinates(x=integer_slider, y=integer_slider_2, z=integer_slider_3)
length = Vector.Length(vector=byCoordinates_2)
byStartPointDirectionLength = Line.ByStartPointDirectionLength(startPoint=byCoordinates, direction=byCoordinates_2, length=length)
translate_2 = Geometry.Translate(geometry=byStartPointDirectionLength)  # unwired: direction
transform = Geometry.Transform()  # unwired: geometry, cs
transform_2 = Geometry.Transform()  # unwired: geometry, fromCoordinateSystem, contextCoordinateSystem
transform_origin = Custom[Transform Origin]()  # package archi-lab.net; This node will query an element for its Transform (Coordinate System) and then return its Origin point.; unwired: element
toPoint = Custom[Transform.ToPoint]()  # package archi-lab.net; This node takes a Transform and an input point that will be translated by the Transform.; unwired: transform, point
XAxis = Vector.XAxis()
code_block = CodeBlock { 82; }
rotate = Vector.Rotate(vector=byCoordinates_2, axis=XAxis, degrees=code_block)
X = Vector.X(vector=rotate)
Y = Vector.Y(vector=rotate)
Z = Vector.Z(vector=rotate)
X_2 = Vector.X(vector=byCoordinates_2)
Y_2 = Vector.Y(vector=byCoordinates_2)
Z_2 = Vector.Z(vector=byCoordinates_2)
direction = Line.Direction()  # unwired: line
byStartPointDirectionLength_2 = Line.ByStartPointDirectionLength(startPoint=byCoordinates, direction=rotate, length=length)
rotate_2 = Geometry.Rotate()  # unwired: geometry, origin, axis
