# Dynamo graph 17ChangeMultipleWallDirection.dyn (Dynamo 2.13.1.3887)
# packages: Clockwork for Dynamo 2.x 2.4.0

file_path = Filename("17files\AllTogether.xlsx")
file_from_path = FileObject(path=file_path)
code_block = CodeBlock { "Wall"; }
importExcel = Data.ImportExcel(file=file_from_path, sheetName=code_block)
transpose = List.Transpose(lists=importExcel)
code_block_2 = CodeBlock { 3; }
getItemAtIndex = List.GetItemAtIndex(list=transpose, index=code_block_2)
code_block_3 = CodeBlock { 0; }
removeItemAtIndex = List.RemoveItemAtIndex(list=getItemAtIndex, indices=code_block_3)

# group: Double to Int
python_script = Python(IN[0]=removeItemAtIndex)  # CPython3
# ---------- python_script.python (17 lines) ----------
# Load the Python Standard and DesignScript Libraries
import sys
import clr
clr.AddReference('ProtoGeometry')
from Autodesk.DesignScript.Geometry import *

# The inputs to this node will be stored as a list in the IN variables.
dataEnteringNode = IN
j = 0
olist = list()
# Place your code below this line
for i in IN:
    for j in i:
        k = int(j)
        olist.append(k)
# Assign your output to the OUT variable.
OUT = olist
# ----------------------------------------
watch = Watch(python_script)

element_by_id = ElementById(Id=python_script)
getLocation = Element.GetLocation(element=element_by_id)
location = Custom[Element.Location+](element=element_by_id)  # package Clockwork for Dynamo 2.x; Returns the location of an element as point, curve or curve loop, along with some booleans to help filtering the results. Unlike the OOTB Element.GetLocation node, it also retunrs sketch lines of sketch-based elements like floor slabs as well as the element's rotation property.
startPoint = Curve.StartPoint(curve=location.curves)
ZAxis = Vector.ZAxis()
code_block_4 = CodeBlock { 18; }
getItemAtIndex_2 = List.GetItemAtIndex(list=transpose, index=code_block_4)
removeItemAtIndex_2 = List.RemoveItemAtIndex(list=getItemAtIndex_2, indices=code_block_3)
rotate = Geometry.Rotate(geometry=getLocation, origin=startPoint, axis=ZAxis, degrees=removeItemAtIndex_2)
setLocation = Element.SetLocation(element=element_by_id, geometry=rotate)
code_block_5 = CodeBlock { 1441841; }
byID = Custom[Element.ByID](IdOrUniqueId=code_block_5)  # package Clockwork for Dynamo 2.x; Gets the Revit element(s) for a list of IDs (or a single ID). Optionally retrieves elements from linked documents as well.
watch_2 = Watch(removeItemAtIndex)
watch_3 = Watch(getItemAtIndex)
orientation = Custom[Wall.Orientation]()  # package Clockwork for Dynamo 2.x; Gets the orientation of a given wall instance (normal of the exterior face of the wall). Will *not* work for walls hosted on mass faces or in-place walls.; unwired: wall
watch_4 = Watch(location.curveEndpoints)
YAxis = Vector.YAxis()
watch_5 = Watch(rotate)
watch_6 = Watch(location.curves)
watch_7 = Watch()  # unwired: arg0
XAxis = Vector.XAxis()
watch_8 = Watch(removeItemAtIndex_2)
