# Dynamo graph get_rooms_3WallSEpointsOrientation.dyn (Dynamo 2.13.1.3887)
# packages: archi-lab.net 2023.213.1622, Clockwork for Dynamo 2.x 2.4.0, Spring - Dynamo 2.0 0.0.3

# group: Extract walls, doors, and windows of "Placed only" rooms by the level of the building
levels = Levels("1ER ETAGE")
boolean = BoolSelector(true)
get_rooms_by_level = Custom[Get Rooms by Level](level=levels, excludeUnplaced=boolean)  # package archi-lab.net; Filters Rooms by level.
python_script = Python(IN[0]=get_rooms_by_level.room)  # CPython3
# ---------- python_script.python (46 lines) ----------
# Load the Python Standard and DesignScript Libraries
import sys
import clr
clr.AddReference('ProtoGeometry')
from Autodesk.DesignScript.Geometry import *

# The inputs to this node will be stored as a list in the IN variables.
clr.AddReference("RevitNodes")
import Revit
clr.ImportExtensions(Revit.Elements)
clr.ImportExtensions(Revit.GeometryConversion)

clr.AddReference("RevitServices")
import RevitServices
from RevitServices.Persistence import DocumentManager
from RevitServices.Transactions import TransactionManager

clr.AddReference("RevitAPI")

clr.AddReference("RevitAPI")
import Autodesk
from Autodesk.Revit.DB import *

doc = DocumentManager.Instance.CurrentDBDocument

rooms_d = IN[0] if isinstance(IN[0], list) else [IN[0]]
roomss = UnwrapElement(rooms_d)

settings = Autodesk.Revit.DB.AreaVolumeSettings.GetAreaVolumeSettings(doc)

options = Autodesk.Revit.DB.SpatialElementBoundaryOptions()
b_option = settings.GetSpatialElementBoundaryLocation(SpatialElementType.Room)

options.SpatialElementBoundaryLocation = b_option

curveslist = []
for room in roomss:
    curves = []
    for boundlist in room.GetBoundarySegments(options):
        for bound in boundlist:
            curves.append (bound.GetCurve().ToProtoType())
    curveslist.append(curves)
# Place your code below this line

# Assign your output to the OUT variable.
OUT = curveslist
# ----------------------------------------
number = Room.Number(room=get_rooms_by_level.room)
boundaries = archilab.Revit.Elements.Room.Boundaries(room=get_rooms_by_level.room)
clear_list = Custom[Clear List](input=boundaries.Elements)  # package archi-lab.net; This node will remove all Null and Empty Lists from any list.
uniqueItems = List.UniqueItems(list=clear_list)
doors = Custom[Room.Doors](door=get_rooms_by_level.room)  # package Clockwork for Dynamo 2.x; Retrieves all doors that are associated with a room (hosted in walls and roofs).
windows = Custom[Room.Windows](door=get_rooms_by_level.room)  # package Clockwork for Dynamo 2.x; Retrieves all windows that are associated with a room (hosted in walls and roofs).

# group: Separating Wall only of all rooms
type = Object.Type(object=uniqueItems)
code_block = CodeBlock { "Wall"; }
contains = String.Contains(string=type, searchFor=code_block)
filterByBoolMask = List.FilterByBoolMask(list=uniqueItems, mask=contains)
id = Element.Id(element=filterByBoolMask.in)
firstItem = List.FirstItem(list=id@L3)
id_2 = Element.Id(element=uniqueItems)

# group: Extract Door IDs
id_3 = Element.Id(element=doors)

# group: Extract Windows ID
id_4 = Element.Id(element=windows)

# group: Writing Data to Excel
code_block_2 = CodeBlock { "Walls"; 0; 1; false; "Doors"; "Windows"; true; }
exportToExcel = Data.ExportToExcel(sheetName=code_block_2.out0, startRow=code_block_2.out1, startColumn=code_block_2.out1, data=get_rooms_by_level.roomName, overWrite=code_block_2.out3)  # unwired: filePath
file_path = Filename(".\oetrange.xlsx")
exportToExcel_2 = Data.ExportToExcel(sheetName=code_block_2.out0, startRow=code_block_2.out1, startColumn=code_block_2.out2, data=number, overWrite=code_block_2.out3)  # unwired: filePath
code_block_3 = CodeBlock { 2; 3; 4; 5; 6; 7; 8; 9; }
exportToExcel_3 = Data.ExportToExcel(sheetName=code_block_2.out0, startRow=code_block_2.out1, startColumn=code_block_3.out0, data=firstItem, overWrite=code_block_2.out3)  # unwired: filePath
exportToExcel_4 = Data.ExportToExcel(sheetName=code_block_2.out4, startRow=code_block_2.out1, startColumn=code_block_2.out1, data=id_3, overWrite=code_block_2.out3)  # unwired: filePath
exportToExcel_5 = Data.ExportToExcel(sheetName=code_block_2.out5, startRow=code_block_2.out1, startColumn=code_block_2.out1, data=id_4, overWrite=code_block_2.out3)  # unwired: filePath

# group: Sorting by ID
identity = Object.Identity(object=doors)
flatten = List.Flatten(list=identity)
watch_heigth = Watch(flatten)
id_5 = Element.Id(element=identity)
flatten_2 = List.Flatten(list=id_5)
watch_heigth_2 = Watch(flatten_2)
sort = List.Sort(list=watch_heigth_2)
indexOf = List.IndexOf(list=sort, element=watch_heigth_2)
sortByAnother = Lists.Lists.SortByAnother(inputList=watch_heigth, sortBy=indexOf)
getItemAtIndex = List.GetItemAtIndex(list=watch_heigth, index=indexOf)
watch_heigth_3 = Watch(getItemAtIndex)
watch_heigth_4 = Watch(indexOf)
watch_heigth_5 = Watch(sort)

# group: Sorting by ID > Remove Duplicates
uniqueItems_2 = List.UniqueItems(list=sortByAnother.sortedList)

# group (continued): Sorting by ID
watch_heigth_6 = Watch(uniqueItems_2)

# group: Doors Height / Width
parameters = Element.Parameters(element=watch_heigth_6)
watch = Watch(parameters)
code_block_4 = CodeBlock { "Type"; "Host Id"; "Type Id"; "Area"; }
getParameterValueByName = Element.GetParameterValueByName(element=watch_heigth_6, parameterName=code_block_4.out0)
python_script_2 = Python(IN[0]=getParameterValueByName)  # CPython3
# ---------- python_script_2.python (37 lines) ----------
# Load the Python Standard and DesignScript Libraries
import sys
import clr
clr.AddReference('ProtoGeometry')
from Autodesk.DesignScript.Geometry import *


# The inputs to this node will be stored as a list in the IN variables.
dataEnteringNode = IN

# Place your code below this line

ListOutputWidth = list()
ListOutputHeight = list()



for i in IN:
    for k in i:
        ss = k
        ss = str(ss)
        ss = ss.split(" ")
        ss = ss[2]
        ss = ss.rstrip(",")
        
        ss = ss.split("x")
        
        sWidth = ss[0]
        sHeigth = ss[1]
        ListOutputWidth.append(sWidth)
        

        ListOutputHeight.append(sHeigth)

                
# Assign your output to the OUT variable.
OUT = ListOutputWidth,ListOutputHeight
# ----------------------------------------
code_block_5 = CodeBlock { 1; 2; }
list_takeitems_width = List.TakeItems(list=python_script_2, amount=code_block_5.out0)
watch_width = Watch(list_takeitems_width)
slice = List.Slice(list=python_script_2, start=code_block_5.out0, end=code_block_5.out1)
watch_heigth_7 = Watch(slice)
getParameterValueByName_2 = Element.GetParameterValueByName(element=watch_heigth_6, parameterName=code_block_4.out3)
id_6 = Element.Id(element=watch_heigth_6)
watch_id = Watch(id_6)

# group: STAIRS Getting Stair Height and Width ( calculated | not so accuarate, review ) > All Stairs
categories = Categories("OST_Stairs")
all_elements_of_category = ElementsOfCategory(Category=categories)

# group: STAIRS Getting Stair Height and Width ( calculated | not so accuarate, review ) > Stairs parameters
parameters_2 = Element.Parameters(element=all_elements_of_category)
watch_2 = Watch(parameters_2)

# group: STAIRS Getting Stair Height and Width ( calculated | not so accuarate, review )
code_block_6 = CodeBlock { numberRisers; riserHeigth; treadDepth; calcStairHeight = riserHeigth * numberRisers; }  # unwired: numberRisers, riserHeigth, treadDepth
code_block_7 = CodeBlock { "Type ID"; }
code_block_8 = CodeBlock { "https://www.youtube.com/watch?v=DdR7Bzh8Vmk&ab_channel=DanamoBIM"; }

# group: STAIRS Getting Stair Height and Width ( calculated | not so accuarate, review ) > Sort stairs by Id
getParameterValueByName_3 = Element.GetParameterValueByName(element=all_elements_of_category, parameterName=code_block_7)
groupByKey = List.GroupByKey(list=all_elements_of_category, keys=getParameterValueByName_3)

# group: STAIRS Getting Stair Height and Width ( calculated | not so accuarate, review ) > Remove Duplicates
uniqueItems_3 = List.UniqueItems(list=groupByKey.groups)
watch_3 = Watch(uniqueItems_3)

# group (continued): STAIRS Getting Stair Height and Width ( calculated | not so accuarate, review )
watch_4 = Watch(watch_3)

# group: STAIRS Getting Stair Height and Width ( calculated | not so accuarate, review ) > Getting specific elements ( sorted by *Parameter * )
code_block_9 = CodeBlock { "Actual Number of Risers"; "Desired Stair Height"; "Actual Riser Height"; "Actual Tread Depth"; }
actual_number_of_risers_element = Element.GetParameterValueByName(element=watch_3, parameterName=code_block_9.out0)
actual_riser_heigth_element = Element.GetParameterValueByName(element=watch_3, parameterName=code_block_9.out2)
desired_stair_height_element = Element.GetParameterValueByName(element=watch_3, parameterName=code_block_9.out1)
actual_tread_depth_element = Element.GetParameterValueByName(element=watch_3, parameterName=code_block_9.out3)

# group: STAIRS Getting Stair Height and Width ( calculated | not so accuarate, review ) > Flatten Lists
watch_5 = Watch(actual_number_of_risers_element)
watch_6 = Watch(actual_riser_heigth_element)
watch_7 = Watch(desired_stair_height_element)
watch_8 = Watch(actual_tread_depth_element)
flatten_3 = List.Flatten(list=actual_number_of_risers_element)
flatten_4 = List.Flatten(list=actual_tread_depth_element)
flatten_5 = List.Flatten(list=actual_riser_heigth_element)

# group: Room Id, Areas, perimeter, Name
identity_2 = Object.Identity(object=get_rooms_by_level.room)

# group: Room Id, Areas, perimeter, Name > Sort by * ID *
code_block_10 = CodeBlock { "Type ID"; }
getParameterValueByName_4 = Element.GetParameterValueByName(element=identity_2, parameterName=code_block_10)
groupByKey_2 = List.GroupByKey(list=identity_2, keys=getParameterValueByName_4)

# group: Room Id, Areas, perimeter, Name > Remove Duplicates
uniqueItems_4 = List.UniqueItems(list=groupByKey_2.groups)
watch_9 = Watch(uniqueItems_4)

# group (continued): Room Id, Areas, perimeter, Name
identity_3 = Object.Identity(object=watch_9)

# group: Room Id, Areas, perimeter, Name > Get parameters
parameters_3 = Element.Parameters(element=identity_3)
watch_10 = Watch(parameters_3)
getLocation = Element.GetLocation(element=identity_3)
watch_11 = Watch(getLocation)
name = Room.Name(room=identity_3)
watch_12 = Watch(name)

# group: Sorting by ID
identity_4 = Object.Identity(object=windows)
flatten_6 = List.Flatten(list=identity_4)
watch_heigth_8 = Watch(flatten_6)
id_7 = Element.Id(element=identity_4)
flatten_7 = List.Flatten(list=id_7)
watch_heigth_9 = Watch(flatten_7)
sort_2 = List.Sort(list=watch_heigth_9)
indexOf_2 = List.IndexOf(list=sort_2, element=watch_heigth_9)
sortByAnother_2 = Lists.Lists.SortByAnother(inputList=watch_heigth_8, sortBy=indexOf_2)
watch_heigth_10 = Watch(sortByAnother_2.sortedList)
getItemAtIndex_2 = List.GetItemAtIndex(list=watch_heigth_8, index=indexOf_2)
watch_heigth_11 = Watch(getItemAtIndex_2)
watch_heigth_12 = Watch(indexOf_2)
watch_heigth_13 = Watch(sort_2)

# group: Remove Duplicates
uniqueItems_5 = List.UniqueItems(list=watch_heigth_10)
watch_13 = Watch(uniqueItems_5)

# group: Window Width / Height ( compare w bimvision )
identity_5 = Object.Identity(object=watch_13)
watch_14 = Watch()  # unwired: arg0
id_8 = Element.Id(element=identity_5)
code_block_11 = CodeBlock { "Sill Height"; "Head Height"; "Area"; "Type"; }
getParameterValueByName_5 = Element.GetParameterValueByName(element=identity_5, parameterName=code_block_11.out3)
window_id = Watch(getParameterValueByName_5)
code_block_12 = CodeBlock { "Width"; }
getParameterValueByName_6 = Element.GetParameterValueByName(element=identity_5, parameterName=code_block_12)
window_width = Watch(getParameterValueByName_6)
getParameterValueByName_7 = Element.GetParameterValueByName(element=identity_5, parameterName=code_block_11.out0)
getParameterValueByName_8 = Element.GetParameterValueByName(element=identity_5, parameterName=code_block_11.out1)
code_block_13 = CodeBlock(a=getParameterValueByName_7, b=getParameterValueByName_8) { a; b; c = b - a; }
list_create = List.Create(item0=code_block_13.c)
window_height = Watch(list_create)
getParameterValueByName_9 = Element.GetParameterValueByName(element=identity_5, parameterName=code_block_11.out2)
window_area = Watch(getParameterValueByName_9)

# group: Window Width / Height ( compare w bimvision ) > Get parameters
parameters_4 = Element.Parameters(element=identity_5)
watch_15 = Watch(parameters_4)
getLocation_2 = Element.GetLocation(element=identity_5)
watch_16 = Watch(getLocation_2)

flatten_8 = List.Flatten(list=watch_heigth_6)
getParameterValueByName_10 = Element.GetParameterValueByName(element=flatten_8, parameterName=code_block_4.out1)

# group: STAIRS Getting Stair Height and Width ( calculated | not so accuarate, review ) > Desired Stair Height
flatten_9 = List.Flatten(list=desired_stair_height_element)
watch_17 = Watch(flatten_9)

# group: STAIRS Getting Stair Height and Width ( calculated | not so accuarate, review ) > Stair Width ( not correct )
calculate_stair_width_python = Python(IN[0]=flatten_3, IN[1]=flatten_4)  # "Calculate Stair Width Python Script"; CPython3
# ---------- calculate_stair_width_python.python (17 lines) ----------
# Load the Python Standard and DesignScript Libraries
import sys
import clr
clr.AddReference('ProtoGeometry')
from Autodesk.DesignScript.Geometry import *

# The inputs to this node will be stored as a list in the IN variables.
nR = IN[0]
tD = IN[1]
cSW = list()
# Place your code below this line
for i in range(len(nR)):
    inter = (nR[i] * tD[i])
    cSW.append(inter)
#calcStairHeigth = riserHeigth * numberRisers;
# Assign your output to the OUT variable.
OUT = cSW
# ----------------------------------------
watch_18 = Watch(calculate_stair_width_python)

# group: STAIRS Getting Stair Height and Width ( calculated | not so accuarate, review ) > Calculate Stair Height with riserHeight * number of Risers(not correct )
calculate_stair_height_with = Python(IN[0]=flatten_3, IN[1]=flatten_5)  # "Calculate Stair Height with riserHeight * number of Risers Python Script"; CPython3; unwired: IN[2]
# ---------- calculate_stair_height_with.python (17 lines) ----------
# Load the Python Standard and DesignScript Libraries
import sys
import clr
clr.AddReference('ProtoGeometry')
from Autodesk.DesignScript.Geometry import *

# The inputs to this node will be stored as a list in the IN variables.
nR = IN[0]
rH = IN[1]
cSH = list()
# Place your code below this line
for i in range(len(nR)):
    inter = (nR[i] * rH[i])
    cSH.append(inter)
#calcStairHeigth = riserHeigth * numberRisers;
# Assign your output to the OUT variable.
OUT = cSH
# ----------------------------------------
watch_19 = Watch(calculate_stair_height_with)

# group: STAIRS Getting Stair Height and Width ( calculated | not so accuarate, review ) > Element ID
id_9 = Element.Id(element=watch_3)
flatten_10 = List.Flatten(list=id_9)
watch_20 = Watch(flatten_10)

# group: Extract Stair data Sorted by ID
code_block_14 = CodeBlock { "StairsID"; "CalculatedStairHeight"; "DesiredStairHeight"; "StairWidth"; }
addItemToFront = List.AddItemToFront(item=code_block_14.out2, list=watch_17)
watch_21 = Watch(addItemToFront)
file_path_2 = Filename(".\AllTogether")
code_block_15 = CodeBlock { "Stairs"; false; 0; 1; 2; 3; 4; 5; }
exportToExcel_6 = Data.ExportToExcel(filePath=file_path_2, sheetName=code_block_15.out0, startRow=code_block_15.out2, startColumn=code_block_15.out4, data=addItemToFront, overWrite=code_block_15.out1)
addItemToFront_2 = List.AddItemToFront(item=code_block_14.out3, list=watch_18)
exportToExcel_7 = Data.ExportToExcel(filePath=file_path_2, sheetName=code_block_15.out0, startRow=code_block_15.out2, startColumn=code_block_15.out5, data=addItemToFront_2, overWrite=code_block_15.out1)
addItemToFront_3 = List.AddItemToFront(item=code_block_14.out1, list=watch_19)
watch_22 = Watch(addItemToFront_3)
addItemToFront_4 = List.AddItemToFront(item=code_block_14.out0, list=watch_20)
exportToExcel_8 = Data.ExportToExcel(filePath=file_path_2, sheetName=code_block_15.out0, startRow=code_block_15.out2, startColumn=code_block_15.out2, data=addItemToFront_4, overWrite=code_block_15.out1)
exportToExcel_9 = Data.ExportToExcel(filePath=file_path_2, sheetName=code_block_15.out0, startRow=code_block_15.out2, startColumn=code_block_15.out3, data=addItemToFront_3, overWrite=code_block_15.out1)
watch_23 = Watch(addItemToFront_4)
watch_24 = Watch(addItemToFront_2)

# group: Room Id, Areas, perimeter, Name > Getting specific elements ( sorted by *Parameter * )
code_block_16 = CodeBlock { "Type ID"; "Area"; "Perimeter"; "Name"; }
actual_tread_depth_element_2 = Element.GetParameterValueByName(element=watch_9, parameterName=code_block_16.out2)
desired_stair_height_element_2 = Element.GetParameterValueByName(element=watch_9, parameterName=code_block_16.out3)
actual_riser_heigth_element_2 = Element.GetParameterValueByName(element=watch_9, parameterName=code_block_16.out1)
id_10 = Element.Id(element=watch_9)

# group: Room Id, Areas, perimeter, Name > Flatten Lists
watch_25 = Watch(actual_tread_depth_element_2)
flatten_11 = List.Flatten(list=watch_25)
watch_26 = Watch(desired_stair_height_element_2)
flatten_12 = List.Flatten(list=watch_26)
watch_27 = Watch(actual_riser_heigth_element_2)
flatten_13 = List.Flatten(list=watch_27)
watch_28 = Watch(id_10)
flatten_14 = List.Flatten(list=watch_28)

# group (continued): Room Id, Areas, perimeter, Name
watch_perimeter = Watch(flatten_11)
watch_name = Watch(flatten_12)
watch_area = Watch(flatten_13)
watch_id_2 = Watch(flatten_14)

# group: Extract room data Sorted by ID
code_block_17 = CodeBlock { "RoomId"; "Area"; "Perimeter"; "Name"; }
addItemToFront_5 = List.AddItemToFront(item=code_block_17.out2, list=watch_perimeter)
watch_29 = Watch(addItemToFront_5)
file_path_3 = Filename(".\AllTogether")
code_block_18 = CodeBlock { "Room"; false; 0; 1; 2; 3; 4; 5; }
exportToExcel_10 = Data.ExportToExcel(filePath=file_path_3, sheetName=code_block_18.out0, startRow=code_block_18.out2, startColumn=code_block_18.out4, data=addItemToFront_5, overWrite=code_block_18.out1)
addItemToFront_6 = List.AddItemToFront(item=code_block_17.out3, list=watch_name)
exportToExcel_11 = Data.ExportToExcel(filePath=file_path_3, sheetName=code_block_18.out0, startRow=code_block_18.out2, startColumn=code_block_18.out5, data=addItemToFront_6, overWrite=code_block_18.out1)
addItemToFront_7 = List.AddItemToFront(item=code_block_17.out1, list=watch_area)
watch_30 = Watch(addItemToFront_7)
addItemToFront_8 = List.AddItemToFront(item=code_block_17.out0, list=watch_id_2)
exportToExcel_12 = Data.ExportToExcel(filePath=file_path_3, sheetName=code_block_18.out0, startRow=code_block_18.out2, startColumn=code_block_18.out2, data=addItemToFront_8, overWrite=code_block_18.out1)
exportToExcel_13 = Data.ExportToExcel(filePath=file_path_3, sheetName=code_block_18.out0, startRow=code_block_18.out2, startColumn=code_block_18.out3, data=addItemToFront_7, overWrite=code_block_18.out1)
watch_31 = Watch(addItemToFront_8)
watch_32 = Watch(addItemToFront_6)

# group: Sorting by ID
identity_6 = Object.Identity(object=filterByBoolMask.in)
flatten_15 = List.Flatten(list=identity_6)
watch_heigth_14 = Watch(flatten_15)
id_11 = Element.Id(element=identity_6)
flatten_16 = List.Flatten(list=id_11)
watch_heigth_15 = Watch(flatten_16)
sort_3 = List.Sort(list=watch_heigth_15)
indexOf_3 = List.IndexOf(list=sort_3, element=watch_heigth_15)
sortByAnother_3 = Lists.Lists.SortByAnother(inputList=watch_heigth_14, sortBy=indexOf_3)
watch_heigth_16 = Watch(sortByAnother_3.sortedList)
getItemAtIndex_3 = List.GetItemAtIndex(list=watch_heigth_14, index=indexOf_3)
watch_heigth_17 = Watch(getItemAtIndex_3)
watch_heigth_18 = Watch(indexOf_3)
watch_heigth_19 = Watch(sort_3)

# group: Remove Duplicates
uniqueItems_6 = List.UniqueItems(list=watch_heigth_16)
watch_33 = Watch(uniqueItems_6)

# group: Wall Length
element_by_id = ElementById(Id=id)
parameters_5 = Element.Parameters(element=element_by_id)
watch_34 = Watch(parameters_5)
watch_id_3 = Watch(watch_33)
code_block_19 = CodeBlock { "Length"; "Area"; "Unconnected Height"; "Volume"; "Width"; }
getParameterValueByName_11 = Element.GetParameterValueByName(element=watch_33, parameterName=code_block_19.out2)
getParameterValueByName_12 = Element.GetParameterValueByName(element=watch_33, parameterName=code_block_19.out0)
watch_length = Watch(getParameterValueByName_12)
watch_unconnected_height = Watch(getParameterValueByName_11)
getParameterValueByName_13 = Element.GetParameterValueByName(element=watch_33, parameterName=code_block_19.out1)
watch_area_2 = Watch(getParameterValueByName_13)
getParameterValueByName_14 = Element.GetParameterValueByName(element=watch_33, parameterName=code_block_19.out3)
watch_volume = Watch(getParameterValueByName_14)

getLocation_3 = Element.GetLocation(element=watch_id_3)
watch_location = Watch(getLocation_3)

# group: Calculate Width
flatten_17 = List.Flatten(list=watch_length)
flatten_18 = List.Flatten(list=watch_unconnected_height)
flatten_19 = List.Flatten(list=watch_area_2)
flatten_20 = List.Flatten(list=watch_volume)
calculated_width_python_script = Python(IN[0]=flatten_17, IN[1]=flatten_18, IN[2]=flatten_19, IN[3]=flatten_20)  # CPython3
# ---------- calculated_width_python_script.python (26 lines) ----------
# Load the Python Standard and DesignScript Libraries
import sys
import clr
clr.AddReference('ProtoGeometry')
from Autodesk.DesignScript.Geometry import *

# The inputs to this node will be stored as a list in the IN variables.
dataEnteringNode = IN
leng = IN[0]
hei = IN[1]
Area = IN[2]
Volume = IN[3]
out = list() #width

# Place your code below this line

for i in range(len(Area)):
    inter = (leng[i] * hei[i])
    v1 = Volume[i]
    v2 = v1*1000000
    inter = v2/inter
    
    out.append(inter)

# Assign your output to the OUT variable.
OUT = out
# ----------------------------------------

# group: Flat list, prepare output to excell
python_script_3 = Python(IN[0]=watch_location)  # CPython3
# ---------- python_script_3.python (37 lines) ----------
# Load the Python Standard and DesignScript Libraries
import sys
import clr
clr.AddReference('ProtoGeometry')
from Autodesk.DesignScript.Geometry import *

# The inputs to this node will be stored as a list in the IN variables.
dataEnteringNode = IN
out = list()

# Place your code below this line

for i in IN:
    for l in i:
        ss = str(l)
        ss = ss.split(" ")
                
           
                
        ss2 = ss[32]
               
                
                
        out.append(ss2)
                
                
                
                
                
           
          
            
            
           

# Assign your output to the OUT variable.
OUT = out
# ----------------------------------------
vector_direction_vector_z = Watch(python_script_3)
flatten_21 = List.Flatten(list=vector_direction_vector_z)
id_12 = Element.Id(element=watch_33)
watch_id_4 = Watch(id_12)
flatten_22 = List.Flatten(list=watch_id_4)
python_script_4 = Python(IN[0]=watch_location)  # CPython3
# ---------- python_script_4.python (37 lines) ----------
# Load the Python Standard and DesignScript Libraries
import sys
import clr
clr.AddReference('ProtoGeometry')
from Autodesk.DesignScript.Geometry import *

# The inputs to this node will be stored as a list in the IN variables.
dataEnteringNode = IN
out = list()

# Place your code below this line

for i in IN:
    for l in i:
        ss = str(l)
        ss = ss.split(" ")
                
           
                
        ss2 = ss[29]
               
                
                
        out.append(ss2)
                
                
                
                
                
           
          
            
            
           

# Assign your output to the OUT variable.
OUT = out
# ----------------------------------------
vector_direction_vector_y = Watch(python_script_4)
flatten_23 = List.Flatten(list=vector_direction_vector_y)
python_script_5 = Python(IN[0]=watch_location)  # CPython3
# ---------- python_script_5.python (37 lines) ----------
# Load the Python Standard and DesignScript Libraries
import sys
import clr
clr.AddReference('ProtoGeometry')
from Autodesk.DesignScript.Geometry import *

# The inputs to this node will be stored as a list in the IN variables.
dataEnteringNode = IN
out = list()

# Place your code below this line

for i in IN:
    for l in i:
        ss = str(l)
        ss = ss.split(" ")
                
           
                
        ss2 = ss[26]
               
                
                
        out.append(ss2)
                
                
                
                
                
           
          
            
            
           

# Assign your output to the OUT variable.
OUT = out
# ----------------------------------------
watch_directionvector_x = Watch(python_script_5)
flatten_24 = List.Flatten(list=watch_directionvector_x)
watch_unconnected_height_2 = Watch(getParameterValueByName_11)
flatten_25 = List.Flatten(list=watch_unconnected_height_2)
watch_width_2 = Watch(calculated_width_python_script)
flatten_26 = List.Flatten(list=watch_width_2)
watch_area_3 = Watch(getParameterValueByName_13)
flatten_27 = List.Flatten(list=watch_area_3)
watch_length_2 = Watch(getParameterValueByName_12)
flatten_28 = List.Flatten(list=watch_length_2)
watch_volume_2 = Watch(getParameterValueByName_14)
flatten_29 = List.Flatten(list=watch_volume_2)

# group: Extract wall data Sorted By Id
code_block_20 = CodeBlock { "VectorX"; "VectorY"; "VectorZ"; "ElementID"; "Length"; "Area"; "Width"; "UnconnectedHeight"; "Volume"; }
addItemToFront_9 = List.AddItemToFront(item=code_block_20.out2, list=flatten_21)
watch_35 = Watch(addItemToFront_9)
file_path_4 = Filename(".\AllTogether")
code_block_21 = CodeBlock { "Wall"; false; 0; 1; 2; 3; 4; 5; 6; 7; 8; }
exportToExcel_14 = Data.ExportToExcel(filePath=file_path_4, sheetName=code_block_21.out0, startRow=code_block_21.out2, startColumn=code_block_21.out4, data=addItemToFront_9, overWrite=code_block_21.out1)
addItemToFront_10 = List.AddItemToFront(item=code_block_20.out3, list=flatten_22)
exportToExcel_15 = Data.ExportToExcel(filePath=file_path_4, sheetName=code_block_21.out0, startRow=code_block_21.out2, startColumn=code_block_21.out5, data=addItemToFront_10, overWrite=code_block_21.out1)
addItemToFront_11 = List.AddItemToFront(item=code_block_20.out1, list=flatten_23)
watch_36 = Watch(addItemToFront_11)
addItemToFront_12 = List.AddItemToFront(item=code_block_20.out0, list=flatten_24)
exportToExcel_16 = Data.ExportToExcel(filePath=file_path_4, sheetName=code_block_21.out0, startRow=code_block_21.out2, startColumn=code_block_21.out2, data=addItemToFront_12, overWrite=code_block_21.out1)
exportToExcel_17 = Data.ExportToExcel(filePath=file_path_4, sheetName=code_block_21.out0, startRow=code_block_21.out2, startColumn=code_block_21.out3, data=addItemToFront_11, overWrite=code_block_21.out1)
watch_37 = Watch(addItemToFront_12)
watch_38 = Watch(addItemToFront_10)
addItemToFront_13 = List.AddItemToFront(item=code_block_20.out7, list=flatten_25)
exportToExcel_18 = Data.ExportToExcel(filePath=file_path_4, sheetName=code_block_21.out0, startRow=code_block_21.out2, startColumn=code_block_21.out9, data=addItemToFront_13, overWrite=code_block_21.out1)
addItemToFront_14 = List.AddItemToFront(item=code_block_20.out6, list=flatten_26)
exportToExcel_19 = Data.ExportToExcel(filePath=file_path_4, sheetName=code_block_21.out0, startRow=code_block_21.out2, startColumn=code_block_21.out8, data=addItemToFront_14, overWrite=code_block_21.out1)
addItemToFront_15 = List.AddItemToFront(item=code_block_20.out5, list=flatten_27)
exportToExcel_20 = Data.ExportToExcel(filePath=file_path_4, sheetName=code_block_21.out0, startRow=code_block_21.out2, startColumn=code_block_21.out7, data=addItemToFront_15, overWrite=code_block_21.out1)
addItemToFront_16 = List.AddItemToFront(item=code_block_20.out4, list=flatten_28)
exportToExcel_21 = Data.ExportToExcel(filePath=file_path_4, sheetName=code_block_21.out0, startRow=code_block_21.out2, startColumn=code_block_21.out6, data=addItemToFront_16, overWrite=code_block_21.out1)
addItemToFront_17 = List.AddItemToFront(item=code_block_20.out8, list=flatten_29)
exportToExcel_22 = Data.ExportToExcel(filePath=file_path_4, sheetName=code_block_21.out0, startRow=code_block_21.out2, startColumn=code_block_21.out10, data=addItemToFront_17, overWrite=code_block_21.out1)
watch_39 = Watch(addItemToFront_16)
watch_40 = Watch(addItemToFront_13)
watch_41 = Watch(addItemToFront_17)
watch_42 = Watch(addItemToFront_15)
watch_43 = Watch(addItemToFront_14)

# group: Extract Door data Sorted by ID
code_block_22 = CodeBlock { "ID"; "Area"; "Width"; "Height"; }
addItemToFront_18 = List.AddItemToFront(item=code_block_22.out2, list=watch_width)
flatten_30 = List.Flatten(list=addItemToFront_18)
watch_44 = Watch(flatten_30)
file_path_5 = Filename(".\AllTogether")
code_block_23 = CodeBlock { "Door"; false; 0; 1; 2; 3; 4; 5; }
exportToExcel_23 = Data.ExportToExcel(filePath=file_path_5, sheetName=code_block_23.out0, startRow=code_block_23.out2, startColumn=code_block_23.out4, data=flatten_30, overWrite=code_block_23.out1)
addItemToFront_19 = List.AddItemToFront(item=code_block_22.out3, list=watch_heigth_7)
flatten_31 = List.Flatten(list=addItemToFront_19)
exportToExcel_24 = Data.ExportToExcel(filePath=file_path_5, sheetName=code_block_23.out0, startRow=code_block_23.out2, startColumn=code_block_23.out5, data=flatten_31, overWrite=code_block_23.out1)
addItemToFront_20 = List.AddItemToFront(item=code_block_22.out1, list=getParameterValueByName_2)
watch_45 = Watch(addItemToFront_20)
addItemToFront_21 = List.AddItemToFront(item=code_block_22.out0, list=watch_id)
exportToExcel_25 = Data.ExportToExcel(filePath=file_path_5, sheetName=code_block_23.out0, startRow=code_block_23.out2, startColumn=code_block_23.out2, data=addItemToFront_21, overWrite=code_block_23.out1)
exportToExcel_26 = Data.ExportToExcel(filePath=file_path_5, sheetName=code_block_23.out0, startRow=code_block_23.out2, startColumn=code_block_23.out3, data=addItemToFront_20, overWrite=code_block_23.out1)
watch_46 = Watch(addItemToFront_21)
watch_47 = Watch(flatten_31)

# group: Flatten
flatten_32 = List.Flatten(list=id_8)
flatten_33 = List.Flatten(list=window_id)
flatten_34 = List.Flatten(list=window_width)
flatten_35 = List.Flatten(list=window_height)
flatten_36 = List.Flatten(list=window_area)

# group: Extract Window data Sorted By Id
file_path_6 = Filename(".\AllTogether")
code_block_24 = CodeBlock { "window"; false; 0; 1; 2; 3; 4; 5; }
code_block_25 = CodeBlock { "ElementID"; "WindowLongId"; "WindowWidth"; "WindowHeight"; "WindowArea"; }
addItemToFront_22 = List.AddItemToFront(item=code_block_25.out0, list=flatten_32)
exportToExcel_27 = Data.ExportToExcel(filePath=file_path_6, sheetName=code_block_24.out0, startRow=code_block_24.out2, startColumn=code_block_24.out2, data=addItemToFront_22, overWrite=code_block_24.out1)
addItemToFront_23 = List.AddItemToFront(item=code_block_25.out1, list=flatten_33)
exportToExcel_28 = Data.ExportToExcel(filePath=file_path_6, sheetName=code_block_24.out0, startRow=code_block_24.out2, startColumn=code_block_24.out3, data=addItemToFront_23, overWrite=code_block_24.out1)
addItemToFront_24 = List.AddItemToFront(item=code_block_25.out2, list=flatten_34)
exportToExcel_29 = Data.ExportToExcel(filePath=file_path_6, sheetName=code_block_24.out0, startRow=code_block_24.out2, startColumn=code_block_24.out4, data=addItemToFront_24, overWrite=code_block_24.out1)
addItemToFront_25 = List.AddItemToFront(item=code_block_25.out3, list=flatten_35)
exportToExcel_30 = Data.ExportToExcel(filePath=file_path_6, sheetName=code_block_24.out0, startRow=code_block_24.out2, startColumn=code_block_24.out5, data=addItemToFront_25, overWrite=code_block_24.out1)
addItemToFront_26 = List.AddItemToFront(item=code_block_25.out4, list=flatten_36)
exportToExcel_31 = Data.ExportToExcel(filePath=file_path_6, sheetName=code_block_24.out0, startRow=code_block_24.out2, startColumn=code_block_24.out6, data=addItemToFront_26, overWrite=code_block_24.out1)
watch_48 = Watch(addItemToFront_22)
watch_49 = Watch(addItemToFront_26)
watch_50 = Watch(addItemToFront_25)
watch_51 = Watch(addItemToFront_24)
watch_52 = Watch(addItemToFront_23)

id_13 = Element.Id(element=watch_heigth_6)
watch_directionvector_x_2 = Watch(flatten_24)
python_script_6 = Python(IN[0]=watch_directionvector_x_2)  # CPython3
# ---------- python_script_6.python (19 lines) ----------
# Load the Python Standard and DesignScript Libraries
import sys
import clr
clr.AddReference('ProtoGeometry')
from Autodesk.DesignScript.Geometry import *

# The inputs to this node will be stored as a list in the IN variables.
dataEnteringNode = IN[0]
out = list()
# Place your code below this line
for i in IN:
    for j in i:
        s = j
        s = s.rstrip(',')
        out.append(s)
        
    
# Assign your output to the OUT variable.
OUT = out
# ----------------------------------------
toNumber = String.ToNumber(string=python_script_6)
vector_direction_vector_y_2 = Watch(flatten_23)
python_script_7 = Python(IN[0]=vector_direction_vector_y_2)  # CPython3; same code as python_script_6
toNumber_2 = String.ToNumber(string=python_script_7)
vector_direction_vector_z_2 = Watch(vector_direction_vector_z)
python_script_8 = Python(IN[0]=vector_direction_vector_z_2)  # CPython3; same code as python_script_6
toNumber_3 = String.ToNumber(string=python_script_8)
byCoordinates = Vector.ByCoordinates(x=toNumber, y=toNumber_2, z=toNumber_3)
ZAxis = Vector.ZAxis()
cross = Vector.Cross(vector=byCoordinates, cross=ZAxis)
byCoordinates_2 = Vector.ByCoordinates(z=toNumber_3)
normalized = Vector.Normalized(vector=byCoordinates)
python_script_9 = Python(IN[0]=watch_location)  # CPython3
# ---------- python_script_9.python (38 lines) ----------
# Load the Python Standard and DesignScript Libraries
import sys
import clr
clr.AddReference('ProtoGeometry')
from Autodesk.DesignScript.Geometry import *

# The inputs to this node will be stored as a list in the IN variables.
dataEnteringNode = IN
out = list()

# Place your code below this line

for i in IN:
    for l in i:
        ss = str(l)
        ss = ss.split(" ")
        
        ss3 = ss[4]
        ssx = ss3[:-1]
        
        ss2 = ssx
               
                
                
        out.append(ss2)
                
                
                
                
                
           
          
            
            
           

# Assign your output to the OUT variable.
OUT = out
# ----------------------------------------
watch_directionvector_x_3 = Watch(python_script_9)
python_script_10 = Python(IN[0]=watch_location)  # CPython3
# ---------- python_script_10.python (38 lines) ----------
# Load the Python Standard and DesignScript Libraries
import sys
import clr
clr.AddReference('ProtoGeometry')
from Autodesk.DesignScript.Geometry import *

# The inputs to this node will be stored as a list in the IN variables.
dataEnteringNode = IN
out = list()

# Place your code below this line

for i in IN:
    for l in i:
        ss = str(l)
        ss = ss.split(" ")
        
        ss3 = ss[7]
        ssx = ss3[:-1]
        
        ss2 = ssx
               
                
                
        out.append(ss2)
                
                
                
                
                
           
          
            
            
           

# Assign your output to the OUT variable.
OUT = out
# ----------------------------------------
watch_directionvector_x_4 = Watch(python_script_10)
python_script_11 = Python(IN[0]=watch_location)  # CPython3
# ---------- python_script_11.python (38 lines) ----------
# Load the Python Standard and DesignScript Libraries
import sys
import clr
clr.AddReference('ProtoGeometry')
from Autodesk.DesignScript.Geometry import *

# The inputs to this node will be stored as a list in the IN variables.
dataEnteringNode = IN
out = list()

# Place your code below this line

for i in IN:
    for l in i:
        ss = str(l)
        ss = ss.split(" ")
        
        ss3 = ss[10]
        ssx = ss3[:-2]
        
        ss2 = ssx
               
                
                
        out.append(ss2)
                
                
                
                
                
           
          
            
            
           

# Assign your output to the OUT variable.
OUT = out
# ----------------------------------------
watch_directionvector_x_5 = Watch(python_script_11)
python_script_12 = Python(IN[0]=watch_location)  # CPython3
# ---------- python_script_12.python (38 lines) ----------
# Load the Python Standard and DesignScript Libraries
import sys
import clr
clr.AddReference('ProtoGeometry')
from Autodesk.DesignScript.Geometry import *

# The inputs to this node will be stored as a list in the IN variables.
dataEnteringNode = IN
out = list()

# Place your code below this line

for i in IN:
    for l in i:
        ss = str(l)
        ss = ss.split(" ")
        
        ss3 = ss[7]
        ssx = ss3[:-1]
        
        ss2 = ss
               
                
                
        out.append(ss2)
                
                
                
                
                
           
          
            
            
           

# Assign your output to the OUT variable.
OUT = out
# ----------------------------------------
watch_directionvector_x_6 = Watch(python_script_12)
python_script_13 = Python(IN[0]=watch_location)  # CPython3
# ---------- python_script_13.python (38 lines) ----------
# Load the Python Standard and DesignScript Libraries
import sys
import clr
clr.AddReference('ProtoGeometry')
from Autodesk.DesignScript.Geometry import *

# The inputs to this node will be stored as a list in the IN variables.
dataEnteringNode = IN
out = list()

# Place your code below this line

for i in IN:
    for l in i:
        ss = str(l)
        ss = ss.split(" ")
        
        ss3 = ss[21]
        ssx = ss3[:-2]
        
        ss2 = ssx
               
                
                
        out.append(ss2)
                
                
                
                
                
           
          
            
            
           

# Assign your output to the OUT variable.
OUT = out
# ----------------------------------------
watch_directionvector_x_7 = Watch(python_script_13)
python_script_14 = Python(IN[0]=watch_location)  # CPython3
# ---------- python_script_14.python (38 lines) ----------
# Load the Python Standard and DesignScript Libraries
import sys
import clr
clr.AddReference('ProtoGeometry')
from Autodesk.DesignScript.Geometry import *

# The inputs to this node will be stored as a list in the IN variables.
dataEnteringNode = IN
out = list()

# Place your code below this line

for i in IN:
    for l in i:
        ss = str(l)
        ss = ss.split(" ")
        
        ss3 = ss[18]
        ssx = ss3[:-1]
        
        ss2 = ssx
               
                
                
        out.append(ss2)
                
                
                
                
                
           
          
            
            
           

# Assign your output to the OUT variable.
OUT = out
# ----------------------------------------
watch_directionvector_x_8 = Watch(python_script_14)
python_script_15 = Python(IN[0]=watch_location)  # CPython3
# ---------- python_script_15.python (38 lines) ----------
# Load the Python Standard and DesignScript Libraries
import sys
import clr
clr.AddReference('ProtoGeometry')
from Autodesk.DesignScript.Geometry import *

# The inputs to this node will be stored as a list in the IN variables.
dataEnteringNode = IN
out = list()

# Place your code below this line

for i in IN:
    for l in i:
        ss = str(l)
        ss = ss.split(" ")
        
        ss3 = ss[15]
        ssx = ss3[:-1]
        
        ss2 = ssx
               
                
                
        out.append(ss2)
                
                
                
                
                
           
          
            
            
           

# Assign your output to the OUT variable.
OUT = out
# ----------------------------------------
watch_directionvector_x_9 = Watch(python_script_15)
file_path_7 = Filename(".\AllTogether")
code_block_26 = CodeBlock { "Wall"; false; 0; 9; 10; 11; 12; 13; 14; }
code_block_27 = CodeBlock { "StartPointx"; "StartPointy"; "StartPointz"; "EndPointx"; "EndPointy"; "EndPointz"; }
addItemToFront_27 = List.AddItemToFront(item=code_block_27.out0, list=python_script_9)
exportToExcel_32 = Data.ExportToExcel(filePath=file_path_7, sheetName=code_block_26.out0, startRow=code_block_26.out2, startColumn=code_block_26.out3, data=addItemToFront_27, overWrite=code_block_26.out1)
addItemToFront_28 = List.AddItemToFront(item=code_block_27.out1, list=python_script_10)
exportToExcel_33 = Data.ExportToExcel(filePath=file_path_7, sheetName=code_block_26.out0, startRow=code_block_26.out2, startColumn=code_block_26.out4, data=addItemToFront_28, overWrite=code_block_26.out1)
addItemToFront_29 = List.AddItemToFront(item=code_block_27.out2, list=python_script_11)
exportToExcel_34 = Data.ExportToExcel(filePath=file_path_7, sheetName=code_block_26.out0, startRow=code_block_26.out2, startColumn=code_block_26.out5, data=addItemToFront_29, overWrite=code_block_26.out1)
addItemToFront_30 = List.AddItemToFront(item=code_block_27.out5, list=python_script_13)
exportToExcel_35 = Data.ExportToExcel(filePath=file_path_7, sheetName=code_block_26.out0, startRow=code_block_26.out2, startColumn=code_block_26.out8, data=addItemToFront_30, overWrite=code_block_26.out1)
addItemToFront_31 = List.AddItemToFront(item=code_block_27.out4, list=python_script_14)
exportToExcel_36 = Data.ExportToExcel(filePath=file_path_7, sheetName=code_block_26.out0, startRow=code_block_26.out2, startColumn=code_block_26.out7, data=addItemToFront_31, overWrite=code_block_26.out1)
addItemToFront_32 = List.AddItemToFront(item=code_block_27.out3, list=python_script_15)
exportToExcel_37 = Data.ExportToExcel(filePath=file_path_7, sheetName=code_block_26.out0, startRow=code_block_26.out2, startColumn=code_block_26.out6, data=addItemToFront_32, overWrite=code_block_26.out1)
code_block_28 = CodeBlock { "WallExterior"; }
exteriorDirection = Custom[Wall.ExteriorDirection](wall=uniqueItems_6)  # package archi-lab.net; This node returns exterior direction of the wall as a vector.
addItemToFront_33 = List.AddItemToFront(item=code_block_28, list=exteriorDirection)
python_script_16 = Python(IN[0]=addItemToFront_33)  # CPython3
# ---------- python_script_16.python (19 lines) ----------
# Load the Python Standard and DesignScript Libraries
import sys
import clr
clr.AddReference('ProtoGeometry')
from Autodesk.DesignScript.Geometry import *

# The inputs to this node will be stored as a list in the IN variables.
dataEnteringNode = IN
out = ""
olist = list()
# Place your code below this line
for i in IN:
    for j in i:
        out = j
        out = str(out)
        olist.append(out)
        
# Assign your output to the OUT variable.
OUT = olist
# ----------------------------------------
watch_53 = Watch(python_script_16)
python_script_17 = Python(IN[0]=addItemToFront_33)  # CPython3
# ---------- python_script_17.python (20 lines) ----------
# Load the Python Standard and DesignScript Libraries
import sys
import clr
clr.AddReference('ProtoGeometry')
from Autodesk.DesignScript.Geometry import *

# The inputs to this node will be stored as a list in the IN variables.
dataEnteringNode = IN
out = ""
olist = list()
# Place your code below this line
for i in IN:
    for j in i:
        out = j
        out = str(out)
        out = out[11:17]
        out = out.rstrip(",")
        olist.append(out)
# Assign your output to the OUT variable.
OUT = olist
# ----------------------------------------
watch_54 = Watch(python_script_17)
python_script_18 = Python(IN[0]=addItemToFront_33)  # CPython3
# ---------- python_script_18.python (22 lines) ----------
# Load the Python Standard and DesignScript Libraries
import sys
import clr
clr.AddReference('ProtoGeometry')
from Autodesk.DesignScript.Geometry import *

# The inputs to this node will be stored as a list in the IN variables.
dataEnteringNode = IN
out = ""
olist = list()
# Place your code below this line
for i in IN:
    for j in i:
        out = j
        out = str(out)
        out = out[22:29]
        out = out.lstrip(" ")
        out = out.rstrip(" ")
        out = out.rstrip(",")
        olist.append(out)
# Assign your output to the OUT variable.
OUT = olist
# ----------------------------------------
watch_55 = Watch(python_script_18)
code_block_29 = CodeBlock { 15; 16; }
code_block_30 = CodeBlock { 0; }
code_block_31 = CodeBlock { "VectorX"; "VectorY"; }
replaceItemAtIndex = List.ReplaceItemAtIndex(list=python_script_17, index=code_block_30, item=code_block_31.out0)
exportToExcel_38 = Data.ExportToExcel(filePath=file_path_4, sheetName=code_block_21.out0, startRow=code_block_21.out2, startColumn=code_block_29.out0, data=replaceItemAtIndex, overWrite=code_block_21.out1)
watch_56 = Watch(replaceItemAtIndex)
replaceItemAtIndex_2 = List.ReplaceItemAtIndex(list=python_script_18, index=code_block_30, item=code_block_31.out1)
exportToExcel_39 = Data.ExportToExcel(filePath=file_path_4, sheetName=code_block_21.out0, startRow=code_block_21.out2, startColumn=code_block_29.out1, data=replaceItemAtIndex_2, overWrite=code_block_21.out1)
watch_57 = Watch(replaceItemAtIndex_2)
orientation = Custom[Wall.Orientation](wall=uniqueItems_6)  # package Clockwork for Dynamo 2.x; Gets the orientation of a given wall instance (normal of the exterior face of the wall). Will *not* work for walls hosted on mass faces or in-place walls.

# group: Get parameters
parameters_6 = Element.Parameters(element=uniqueItems_6)
watch_58 = Watch(parameters_6)
getLocation_4 = Element.GetLocation(element=uniqueItems_6)
watch_59 = Watch(getLocation_4)

code_block_32 = CodeBlock { 17; }
code_block_33 = CodeBlock { "Length"; }
python_script_19 = Python(IN[0]=getLocation_4)  # CPython3
# ---------- python_script_19.python (28 lines) ----------
# Load the Python Standard and DesignScript Libraries
import sys
import clr
clr.AddReference('ProtoGeometry')
from Autodesk.DesignScript.Geometry import *

# The inputs to this node will be stored as a list in the IN variables.
dataEnteringNode = IN
out = ""
olist = list()
# Place your code below this line
for i in IN:
    for j in i:
        out = j
        out = str(out)
        out = out[187:]
        out = out.lstrip("n")
        out = out.lstrip("g")
        out = out.lstrip("t")
        out = out.lstrip("h")
        out = out.lstrip("= ")
        out = out.lstrip(" ")
        out = out.rstrip(")")


        olist.append(out)
# Assign your output to the OUT variable.
OUT = olist
# ----------------------------------------
watch_60 = Watch(python_script_19)
addItemToFront_34 = List.AddItemToFront(item=code_block_33, list=watch_60)
exportToExcel_40 = Data.ExportToExcel(filePath=file_path_4, sheetName=code_block_21.out0, startRow=code_block_21.out2, startColumn=code_block_32, data=addItemToFront_34, overWrite=code_block_21.out1)
watch_61 = Watch(addItemToFront_34)
